# Grasshopper definition MMM212_24.gh (Grasshopper 1.0.7)
# plug-ins: Kangaroo2 Components, Weaverbird, Pufferfish

trame_de_sructure = Slider(3, range=2..6)
trame_de_sructure_2 = GetNumber(trame_de_sructure, AtLeast=1, AtMost=1, Maximum=1.797693135e+308, Minimum=-1.797693135e+308)

radius = Slider(4, range=1..4)
number_of_façades = GetNumber(radius, AtLeast=1, AtMost=1, Maximum=1.797693135e+308, Minimum=-1.797693135e+308)

radius_2 = Slider(20, range=7..20)
count = Slider(20, range=7..20)
depth = GetNumber(count, AtLeast=1, AtMost=1, Maximum=1.797693135e+308, Minimum=-1.797693135e+308)
length = GetNumber(radius_2, AtLeast=1, AtMost=1, Maximum=1.797693135e+308, Minimum=-1.797693135e+308)

repeat = RepeatData(Data="0", Length="4")
repeat_2 = RepeatData(Data="1", Length="4")
series = Series(Start=0, Step=1, Count=number_of_façades)
item = ListItem(List=repeat_2, Index=series, Wrap=True)
replace = ReplaceItems(List=repeat, Item=item, Indices=series, Wrap=False)
panel = Panel(replace)

# ---- group: SECTION POTEAU
section_poteaux = Slider(0.25, range=0..1)

# ----
num = Number(expr("X/2", section_poteaux))
dom = ConstructDomain(DomainStart=expr("x/2", length), DomainEnd=expr("-x/2", length))
dom_2 = ConstructDomain(DomainStart=expr("x/2", depth), DomainEnd=expr("-x/2", depth))
rectangle = Rectangle(Plane=PlaneXY(0, 0, 0), XSize=dom, YSize=dom_2, Radius=0)  # -> Rectangle, Length
bbox = BoundingBox(Content=rectangle.Rectangle, Plane=PlaneXY(0, 0, 0))  # -> Box, Box_2
debrep = DeconstructBrep(Brep=bbox.Box)  # -> Faces, Edges, Vertices
item_2 = ListItem(List=debrep.Faces, Index=0, Wrap=True)
offset = OffsetCurve(Curve=item_2, Distance=expr("-X", num), Plane=PlaneXY(0, 0, 0), Corners=1)
explode = Explode(Curve=offset, Recursive=True)  # -> Segments, Vertices
crv = Curve(explode.Segments)
len = Length(Curve=crv)
division = Division(A=len, B=trame_de_sructure_2)
int = Integer(division)
item_3 = ListItem(List=int, Index=0, Wrap=True)  # -> Item, Item1
srf = Surface(offset)
wires = BrepWireframe(Brep=item_2, Density=-1)
divide = DivideDomain²(Domain=srf, UCount=item_3.Item, VCount=item_3.Item1)
subsrf = Isotrim(Surface=graft(srf), Domain=divide)
dispatch = Dispatch(List=wires, DispatchPattern=panel)  # -> ListA, ListB
explode_2 = Explode(Curve=subsrf, Recursive=True)  # -> Segments, Vertices
number_slider = Slider(1, range=0..10)
crv_2 = Curve(simplify(graft(dispatch.ListA)))
item_4 = ListItem(List=explode_2.Segments, Index=0, Wrap=True)  # -> Item, Item1, Item2, Item3
dom_3 = ConstructDomain(DomainStart=expr("-X", num), DomainEnd=num)
cullpt = CullDuplicates(Points=flatten(explode_2.Vertices), Tolerance=0.1, CullMode=3)  # -> Points, Indices, Valence
crv_3 = Curve(flatten([item_4.Item1, item_4.Item3]))
offset_2 = OffsetCurve(Curve=crv_2, Distance=expr("0", number_slider), Plane=PlaneXY(0, 0, 0), Corners=1)  # -> simplify(graft(Curve))
crv_4 = Curve(flatten([item_4.Item, item_4.Item2]))
offset_3 = OffsetCurve(Curve=crv_2, Distance=number_slider, Plane=PlaneXY(0, 0, 0), Corners=1)  # -> simplify(graft(Curve))
rectangle_2 = Rectangle(Plane=cullpt.Points, XSize=dom_3, YSize=dom_3, Radius=0)  # -> Rectangle, Length
dupln = RemoveDuplicateLines(Lines=crv_3, Tolerance=0.01)
dupln_2 = RemoveDuplicateLines(Lines=crv_4, Tolerance=0.01)
loft = Loft(
    Curves=[offset_2, offset_3],
    Options={Adjust=False, Closed=False, LoftEnds=0, LoftSimp=0, LoftType=0, Rebuild=10, Refit=0.01})
srf_2 = Surface(rectangle_2.Rectangle)
join = JoinCurves(Curves=dupln_2, Preserve=False)
join_2 = JoinCurves(Curves=dupln, Preserve=False)
addition = Addition(A=number_slider, B=num)
join_3 = BrepJoin(Breps=flatten([item_2, loft]))  # -> Breps, Closed
ext = ExtendCurve(Curve=flatten([join, join_2]), Type=0, Start=addition, End=addition)
fmerge = MergeFaces(Brep=join_3.Breps)  # -> Breps, Before, After
crv_5 = Curve(simplify(graft(ext)))
wires_2 = BrepWireframe(Brep=fmerge.Breps, Density=-1)
join_4 = JoinCurves(Curves=wires_2, Preserve=False)
ccx = CurveCurve(CurveA=crv_5, CurveB=join_4)  # -> Points, ParamsA, ParamsB
shatter = Shatter(Curve=crv_5, Parameters=ccx.ParamsA)
bbox_2 = BoundingBox(Content=join_4, Plane=PlaneXY(0, 0, 0))  # -> Box, Box_2
debrep_2 = DeconstructBrep(Brep=bbox_2.Box)  # -> Faces, Edges, Vertices
curvepoint = PointOnCurve(shatter, parameter=0.5)
item_5 = ListItem(List=debrep_2.Faces, Index=0, Wrap=True)
incurve = PointInCurve(Point=curvepoint, Curve=join_4)  # -> Relationship, Point
wires_3 = BrepWireframe(Brep=item_5, Density=-1)
cull = CullPattern(List=shatter, CullPattern=incurve.Relationship)  # -> simplify(List)
dispatch_2 = Dispatch(List=wires_3, DispatchPattern=panel)  # -> ListA, ListB
offset_4 = OffsetCurve(Curve=cull, Distance=expr("-X", num), Plane=PlaneXY(0, 0, 0), Corners=1)
offset_5 = OffsetCurve(Curve=cull, Distance=num, Plane=PlaneXY(0, 0, 0), Corners=1)
Z = UnitZ(Factor=expr("-X", section_poteaux))
loft_2 = Loft(
    Curves=[offset_4, offset_5],
    Options={Adjust=False, Closed=False, LoftEnds=0, LoftSimp=0, LoftType=0, Rebuild=10, Refit=0.01})
extr = Extrude(Base=loft_2, Direction=Z)

number_of_floors = Slider(2, range=1..4)
number_of_floors_2 = GetNumber(number_of_floors, AtLeast=1, AtMost=1, Maximum=1.797693135e+308, Minimum=-1.797693135e+308)

# ---- group: garde corps terrasse
number_slider_2 = Slider(1.2, range=0..10)

# ---- group: Hauteur RDC
number_slider_3 = Slider(3.5, range=0..10)

# ----
number_slider_4 = Slider(1.06, range=0..10)
offset_6 = OffsetCurve(Curve=dispatch.ListA, Distance=Slider(3, range=0..10), Corners=1)
tree_geometry = Mesh([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])
ext_2 = ExtendCurve(Curve=offset_6, Type="0", Start=number_slider_4, End=number_slider_4)  # -> flatten(Curve)
group = Group(Objects=tree_geometry)
bbox_3 = BoundingBox(Content=group, Plane=PlaneXY(0, 0, 0))  # -> Box, Box_2
debrep_3 = DeconstructBrep(Brep=bbox_3.Box)  # -> Faces, Edges, Vertices
area = Area(Geometry=debrep_3.Faces)  # -> Area, Centroid
divdist = DivideDistance(Curve=ext_2, Distance=Slider(5, range=0..10))  # -> Points, Tangents, Parameters
lng = ListLength(List=divdist.Points)
pdecon = Deconstruct(Point=area.Centroid)  # -> XComponent, YComponent, ZComponent
cull_i = CullIndex(List=simplify(divdist.Points), Indices="0", Wrap=True)
sort = SortList(Keys=pdecon.ZComponent, ValuesA=debrep_3.Faces)  # -> Keys, ValuesA
item_6 = ListItem(List=sort.ValuesA, Index=0, Wrap=True)
area_2 = Area(Geometry=item_6)  # -> Area, Centroid
move2pt = MoveToPoint(Geometry=group, PointA=area_2.Centroid, PointB=cull_i)  # -> Moved, Vector, Transform
ungroup = Ungroup(Group=move2pt.Moved)  # -> flatten(Objects)

prix_de_ventre_m² = Slider(7000, range=1..99999)
selling_price_m² = GetNumber(prix_de_ventre_m², AtLeast=1, AtMost=1, Maximum=1.797693135e+308, Minimum=-1.797693135e+308)

prix_du_lot_m² = Slider(4000, range=1..99999)
land_price_m² = GetNumber(prix_du_lot_m², AtLeast=1, AtMost=1, Maximum=1.797693135e+308, Minimum=-1.797693135e+308)

prix_du_lot_m²_2 = Slider(1000, range=1..99999)
structure_shell_price_m² = GetNumber(prix_du_lot_m²_2, AtLeast=1, AtMost=1, Maximum=1.797693135e+308, Minimum=-1.797693135e+308)

prix_du_lot_m²_3 = Slider(2000, range=1..99999)
interior_finishing_price_m² = GetNumber(prix_du_lot_m²_3, AtLeast=1, AtMost=1, Maximum=1.797693135e+308, Minimum=-1.797693135e+308)

# ---- group: nombre de porte dentree
number_slider_5 = Slider(1, range=0..10)

# ---- group: seed facade compisition
number_slider_6 = Slider(3, range=0..10)

# ---- group: largeur
number_slider_7 = Slider(2.1, range=0..10)

# ---- group: appui fenetre
number_slider_8 = Slider(1.2, range=0..10)

# ---- group: appui
number_slider_9 = Slider(0.8, range=0..10)

# ---- group: largeur
number_slider_10 = Slider(1.7, range=0..10)

# ---- group: hauteur
number_slider_11 = Slider(1.1, range=0..2)

number_slider_12 = Slider(2.2, range=0..2.6)

# ---- group: nombre de balcons
number_slider_13 = Slider(1, range=0..10)

# ----
nombres_de_garages = Slider(2, range=0..10)
data = Data(nombres_de_garages)

# ---- group: hauteur garde corps
number_slider_14 = Slider(1, range=0..1)

# ----
number_slider_15 = Slider(1, range=0..10)
neg = Negative(Value=Slider(0.23, range=0..1))

# ---- group: largeur
number_slider_16 = Slider(2.5, range=0..10)

number_slider_17 = Slider(1.5, range=0..10)

# ---- group: hauteur
number_slider_18 = Slider(2.8, range=0..10)

# ---- group: hauteur chassis-haut
number_slider_19 = Slider(0.4, range=0..2)

# ---- group: hauteur
number_slider_20 = Slider(2.8, range=0..10)

number_slider_21 = Slider(2.7, range=0..10)

# ----
panel_2 = Panel("""1
2
3""")
dom²num = ConstructDomain²(UMin=0, UMax=1, VMin=Slider(0.22, range=0..1), VMax=1)
swatch = ColourSwatch(SwatchColor=RGB(255, 255, 255))
swatch_2 = ColourSwatch(SwatchColor=RGB(255, 255, 255))
swatch_3 = ColourSwatch(SwatchColor=RGB(0, 0, 0))

crv_6 = Curve(flatten([offset_4, offset_5]))
hauteur_etage = Slider(3.2, range=0..10)
join_5 = JoinCurves(Curves=dispatch_2.ListA, Preserve=False)
join_6 = JoinCurves(Curves=dispatch_2.ListB, Preserve=False)
join_7 = JoinCurves(Curves=dispatch.ListA, Preserve=False)
join_8 = JoinCurves(Curves=dispatch.ListB, Preserve=False)
crv_7 = Curve(join_5)
crv_8 = Curve(join_6)
crv_9 = Curve(join_8)
crv_10 = Curve(join_7)
ccx_2 = CurveCurve(CurveA=crv_10, CurveB=flatten(crv_6))  # -> Points, ParamsA, ParamsB
ccx_3 = CurveCurve(CurveA=crv_8, CurveB=flatten(crv_6))  # -> Points, ParamsA, ParamsB
ccx_4 = CurveCurve(CurveA=crv_9, CurveB=flatten(crv_6))  # -> Points, ParamsA, ParamsB
ccx_5 = CurveCurve(CurveA=crv_7, CurveB=flatten(crv_6))  # -> Points, ParamsA, ParamsB
Z_2 = UnitZ(Factor=number_slider_3)
series_2 = Series(Start=number_slider_3, Step=hauteur_etage, Count=expr("X+1", number_of_floors_2))
series_3 = Series(Start=number_slider_3, Step=hauteur_etage, Count=number_of_floors_2)
shatter_2 = Shatter(Curve=crv_10, Parameters=flatten(ccx_2.ParamsA))
shatter_3 = Shatter(Curve=crv_9, Parameters=flatten(ccx_4.ParamsA))
shatter_4 = Shatter(Curve=crv_8, Parameters=flatten(ccx_3.ParamsA))
shatter_5 = Shatter(Curve=crv_7, Parameters=flatten(ccx_5.ParamsA))
Z_3 = UnitZ(Factor=series_2)
Z_4 = UnitZ(Factor=series_3)
Z_5 = UnitZ(Factor=hauteur_etage)
move = Move(Geometry=item_5, Motion=Z_3)  # -> Geometry, Transform
Z_6 = UnitZ(Factor=section_poteaux)
move_2 = Move(Geometry=shatter_4, Motion=graft(Z_4))  # -> Geometry, Transform
move_3 = Move(Geometry=shatter_5, Motion=graft(Z_4))  # -> Geometry, Transform
move_4 = Move(Geometry=extr, Motion=Z_3)  # -> Geometry, Transform
move_5 = Move(Geometry=srf_2, Motion=graft(Z_4))  # -> Geometry, Transform
rev = ReverseList(List=move.Geometry)
extr_2 = Extrude(Base=move.Geometry, Direction=Z_6)
extr_3 = Extrude(Base=srf_2, Direction=Z_2)
extr_4 = Extrude(Base=move_5.Geometry, Direction=Z_5)
extr_5 = Extrude(Base=shatter_2, Direction=Z_2)
extr_6 = Extrude(Base=shatter_3, Direction=Z_2)
extr_7 = Extrude(Base=move_3.Geometry, Direction=Z_5)
extr_8 = Extrude(Base=move_2.Geometry, Direction=Z_5)
item_7 = ListItem(List=rev, Index=0, Wrap=True)
wires_4 = BrepWireframe(Brep=item_7, Density=-1)
merge = Merge(Data1=move_4.Geometry, Data2=extr_3, Data3=extr_4)
dispatch_3 = Dispatch(List=wires_4, DispatchPattern=panel)  # -> ListA, ListB
join_9 = JoinCurves(Curves=dispatch_3.ListB, Preserve=False)
join_10 = JoinCurves(Curves=dispatch_3.ListA, Preserve=False)
crv_11 = Curve(join_9)
crv_12 = Curve(join_10)
offset_7 = OffsetCurve(Curve=crv_11, Distance=expr("-x", Z_6), Plane=PlaneXY(0, 0, 0), Corners=1)
offset_8 = OffsetCurve(Curve=crv_12, Distance=expr("-x", Z_6), Plane=PlaneXY(0, 0, 0), Corners=1)
Z_7 = UnitZ(Factor=number_slider_2)
Z_8 = UnitZ(Factor=number_slider_2)
loft_3 = Loft(
    Curves=flatten([crv_12, offset_8]),
    Options={Adjust=False, Closed=False, LoftEnds=0, LoftSimp=0, LoftType=0, Rebuild=10, Refit=0.01})
loft_4 = Loft(
    Curves=flatten([crv_11, offset_7]),
    Options={Adjust=False, Closed=False, LoftEnds=0, LoftSimp=0, LoftType=0, Rebuild=10, Refit=0.01})
brep = Brep(move.Geometry)
extr_9 = Extrude(Base=loft_4, Direction=Z_7)
extr_10 = Extrude(Base=loft_3, Direction=Z_8)
brep_2 = Brep(extr_2)
brep_3 = Brep(extr_10)
brep_4 = Brep(extr_9)
brep_5 = Brep(merge)
srf_3 = Surface(extr_8)
srf_4 = Surface(extr_5)
srf_5 = Surface(extr_6)

panel_3 = Panel(extr_7)
cset = CreateSet(List=panel_3)  # -> Set, Map
dispatch_4 = Dispatch(List=extr_7, DispatchPattern=cset.Map)  # -> ListA, ListB

brep_6 = Brep(dispatch_4.ListA)
srf_6 = Surface(dispatch_4.ListB)

srf_7 = Surface(srf_6)
srf_8 = Surface(srf_4)
area_3 = Area(Geometry=flatten(srf_7))  # -> Area, Centroid
area_4 = Area(Geometry=flatten(srf_8))  # -> Area, Centroid
larger = LargerThan(FirstNumber=area_3.Area, SecondNumber=Slider(8, range=0..1000))  # -> LargerThan, OrEqualTo
larger_2 = LargerThan(FirstNumber=area_4.Area, SecondNumber=Slider(8, range=0..1000))  # -> LargerThan, OrEqualTo
dispatch_5 = Dispatch(List=flatten(srf_7), DispatchPattern=larger.LargerThan)  # -> ListA, ListB
dispatch_6 = Dispatch(List=flatten(srf_8), DispatchPattern=larger_2.LargerThan)  # -> ListA, ListB
srf_9 = Surface(dispatch_6.ListB)
srf_10 = Surface(dispatch_5.ListB)

# ---- group: murs aveugles
merge_2 = Merge(Data1=brep_4, Data2=srf_3, Data3=srf_5)

# ----
srf_11 = Surface(graft(dispatch_6.ListA))

srf_12 = Surface(flatten(srf_11))
area_5 = Area(Geometry=srf_12)  # -> Area, Centroid
reduce = RandomReduce(List=area_5.Centroid, Reduction=number_slider_5, Seed=number_slider_6)
srf_13 = Surface(flatten(dispatch_5.ListA))
fsim = FindSimilarMember(Data=reduce, Set=area_5.Centroid)  # -> Hit, Index
area_6 = Area(Geometry=srf_13)  # -> Area, Centroid
item_8 = ListItem(List=srf_12, Index=fsim.Index, Wrap=True)
cull_i_2 = CullIndex(List=srf_12, Indices=fsim.Index, Wrap=True)
srf_14 = Surface(item_8)
reduce_2 = RandomReduce(List=area_6.Centroid, Reduction=number_slider_13, Seed=number_slider_6)
fsim_2 = FindSimilarMember(Data=reduce_2, Set=area_6.Centroid)  # -> Hit, Index
area_7 = Area(Geometry=srf_14)  # -> Area, Centroid
item_9 = ListItem(List=srf_13, Index=fsim_2.Index, Wrap=True)
cull_i_3 = CullIndex(List=srf_13, Indices=fsim_2.Index, Wrap=True)
reduce_3 = RandomReduce(List=area_7.Centroid, Reduction=data, Seed=number_slider_6)
fsim_3 = FindSimilarMember(Data=reduce_3, Set=area_7.Centroid)  # -> Hit, Index
item_10 = ListItem(List=srf_14, Index=fsim_3.Index, Wrap=True)
cull_i_4 = CullIndex(List=srf_14, Indices=fsim_3.Index, Wrap=True)
merge_3 = Merge(Data1=item_10, Data2=item_9)  # -> flatten(Result)
merge_4 = Merge(Data1=cull_i_3)  # -> flatten(Result)
merge_5 = Merge(Data1=cull_i_4)  # -> flatten(Result)
merge_6 = Merge(Data1=cull_i_2)  # -> flatten(Result)

# ---- group: SURFACES > fenetre
srf_15 = Surface(flatten(merge_3))

# ----
wires_5 = BrepWireframe(Brep=srf_15, Density=-1)
area_8 = Area(Geometry=srf_15)  # -> Area, Centroid
item_11 = ListItem(List=wires_5, Index=Slider(3, range=0..10), Wrap=True)
evalsrf = EvaluateSurface(Surface=srf_15, Point=area_8.Centroid)  # -> Point, Normal, UDirection, VDirection, Frame
curvepoint_2 = PointOnCurve(item_11, parameter=0.5)
neg_2 = Negative(Value=number_slider_7)
Z_9 = UnitZ(Factor=expr("x+0.2", number_slider_9))
neg_3 = Negative(Value=number_slider_10)
Z_10 = UnitZ(Factor=expr("x+0.2", number_slider_8))
pl_origin = PlaneOrigin(Base=simplify(graft(evalsrf.Frame)), Origin=simplify(curvepoint_2))
dom_4 = ConstructDomain(DomainStart=expr("x/2", number_slider_7), DomainEnd=expr("x/2", neg_2))
dom_5 = ConstructDomain(DomainStart=expr("x/2", number_slider_10), DomainEnd=expr("x/2", neg_3))
rectangle_3 = Rectangle(Plane=pl_origin, XSize=number_slider_11, YSize=dom_5, Radius=0)  # -> Rectangle, Length
rectangle_4 = Rectangle(Plane=pl_origin, XSize=number_slider_12, YSize=dom_4, Radius=0)  # -> Rectangle, Length
move_6 = Move(Geometry=rectangle_3.Rectangle, Motion=Z_10)  # -> Geometry, Transform
move_7 = Move(Geometry=rectangle_4.Rectangle, Motion=Z_9)  # -> Geometry, Transform
srfsplit = SurfaceSplit(Surface=simplify(graft(srf_15)), Curves=simplify(graft(move_6.Geometry)))
srf_16 = Surface(move_6.Geometry)
merge_7 = Merge(Data1=move_6.Geometry, Data2=move_7.Geometry)
divide_2 = DivideDomain²(Domain=srf_16, UCount=Slider(1, range=0..10), VCount=Slider(11, range=0..100))
area_9 = Area(Geometry=srfsplit)  # -> Area, Centroid
area_10 = Area(Geometry=move_6.Geometry)  # -> Area, Centroid
boundary = BoundarySurfaces(Edges=merge_7)
neg_4 = Negative(Value=Slider(0.08, range=0..0.1))
subsrf_2 = Isotrim(Surface=srf_16, Domain=divide_2)  # -> simplify(Surface)
fsim_4 = FindSimilarMember(Data=area_10.Centroid, Set=area_9.Centroid)  # -> Hit, Index
offset_9 = OffsetSurface(Surface=boundary, Distance=neg_4, Retrim=True)
cull_i_5 = CullIndex(List=srfsplit, Indices=fsim_4.Index, Wrap=True)
item_12 = ListItem(List=srfsplit, Index=fsim_4.Index, Wrap=True)
wires_6 = BrepWireframe(Brep=boundary, Density=-1)  # -> graft(Wireframe)
wires_7 = BrepWireframe(Brep=offset_9, Density=-1)  # -> graft(Wireframe)
rev_2 = ReverseList(List=subsrf_2)
srf_17 = Surface(simplify(item_12))
cull_i_6 = CullIndex(List=rev_2, Indices=Slider(10, range=0..100), Wrap=True)  # -> flatten(List)
loft_5 = Loft(
    Curves=[wires_6, wires_7],
    Options={Adjust=True, Closed=False, LoftEnds=0, LoftSimp=0, LoftType=0, Rebuild=10, Refit=0.01})
merge_8 = Merge(Data1=loft_5, Data2=offset_9, Data3=boundary)  # -> flatten(Result)
offset_10 = OffsetSurface(Surface=srf_17, Distance=Slider(0.23, range=0..1), Retrim=True)
area_11 = Area(Geometry=cull_i_6)  # -> Area, Centroid
join_11 = BrepJoin(Breps=merge_8)  # -> Breps, Closed
loft_6 = Loft(
    Curves=[srf_17, offset_10],
    Options={Adjust=True, Closed=False, LoftEnds=0, LoftSimp=0, LoftType=0, Rebuild=10, Refit=0.01})
wires_8 = BrepWireframe(Brep=cull_i_6, Density=-1)
mesh = Mesh(offset_10)
evalsrf_2 = EvaluateSurface(Surface=flatten(cull_i_6), Point=area_11.Centroid)  # -> Point, simplify(graft(Normal)), UDirection, VDirection, Frame
item_13 = ListItem(List=wires_8, Index=Slider(0, range=0..10), Wrap=True)  # -> simplify(Item)
wbnaked = WeaverbirdsNakedBoundary(MeshClosedPolylines=mesh)
number_slider_22 = Slider(1, range=0..10)
divide_3 = DivideCurve(Curve=item_13, Count=Slider(4, range=0..10), Kinks=False)  # -> Points, Tangents, Parameters
boundary_2 = BoundarySurfaces(Edges=wbnaked)
amp = Amplitude(Vector=evalsrf_2.Normal, Amplitude=Slider(0.18, range=0..1))
item_14 = ListItem(List=divide_3.Points, Index=number_slider_22, Wrap=True)
divide_4 = DivideDomain²(Domain=boundary_2, UCount=Slider(1, range=0..10), VCount=Slider(31, range=0..100))
neg_5 = Negative(Value=amp)
subsrf_3 = Isotrim(Surface=boundary_2, Domain=divide_4)
move_8 = Move(Geometry=simplify(item_14), Motion=neg_5)  # -> Geometry, Transform
panel_4 = Panel("""FALSE
TRUE""")
replace_2 = ReplaceItems(List=simplify(divide_3.Points), Item=simplify(move_8.Geometry), Indices=number_slider_22, Wrap=False)
dispatch_7 = Dispatch(List=subsrf_3, DispatchPattern=panel_4)  # -> ListA, ListB
intcrv = Interpolate(Vertices=replace_2, Degree=3, Periodic=False, KnotStyle=1)  # -> Curve, Length, Domain
srf_18 = Surface(dispatch_7.ListA)
offset_11 = OffsetSurface(Surface=srf_18, Distance=Slider(0.01, range=0..0.1), Retrim=True)

srf_19 = Surface(merge_6)
wires_9 = BrepWireframe(Brep=srf_19, Density=-1)
area_12 = Area(Geometry=srf_19)  # -> Area, Centroid
evalsrf_3 = EvaluateSurface(Surface=srf_19, Point=area_12.Centroid)  # -> Point, Normal, UDirection, VDirection, Frame
item_15 = ListItem(List=wires_9, Index=Slider(3, range=0..10), Wrap=True)
curvepoint_3 = PointOnCurve(item_15, parameter=0.5)
pl_origin_2 = PlaneOrigin(Base=simplify(graft(evalsrf_3.Frame)), Origin=simplify(curvepoint_3))
neg_6 = Negative(Value=number_slider_17)
dom_6 = ConstructDomain(DomainStart=expr("x/2", number_slider_17), DomainEnd=expr("x/2", neg_6))
rectangle_5 = Rectangle(Plane=pl_origin_2, XSize=number_slider_18, YSize=dom_6, Radius=0)  # -> Rectangle, Length
srfsplit_2 = SurfaceSplit(Surface=simplify(srf_19), Curves=rectangle_5.Rectangle)
area_13 = Area(Geometry=rectangle_5.Rectangle)  # -> Area, Centroid
area_14 = Area(Geometry=srfsplit_2)  # -> Area, Centroid
fsim_5 = FindSimilarMember(Data=area_13.Centroid, Set=area_14.Centroid)  # -> Hit, Index
item_16 = ListItem(List=srfsplit_2, Index=fsim_5.Index, Wrap=True)
cull_i_7 = CullIndex(List=srfsplit_2, Indices=fsim_5.Index, Wrap=True)
srf_20 = Surface(item_16)
srf_21 = Surface(cull_i_7)
offset_12 = OffsetSurface(Surface=srf_20, Distance=Slider(0.23, range=0..1), Retrim=True)
loft_7 = Loft(
    Curves=[offset_12, srf_20],
    Options={Adjust=True, Closed=False, LoftEnds=0, LoftSimp=0, LoftType=0, Rebuild=10, Refit=0.01})
merge_9 = Merge(Data1=srf_21, Data2=loft_7)
brep_7 = Brep(merge_9)
srf_22 = Surface(offset_12)

srf_23 = Surface(merge_5)
wires_10 = BrepWireframe(Brep=srf_23, Density=-1)
area_15 = Area(Geometry=srf_23)  # -> Area, Centroid
evalsrf_4 = EvaluateSurface(Surface=srf_23, Point=area_15.Centroid)  # -> Point, Normal, UDirection, VDirection, Frame
item_17 = ListItem(List=wires_10, Index=Slider(3, range=0..10), Wrap=True)
curvepoint_4 = PointOnCurve(item_17, parameter=0.5)
pl_origin_3 = PlaneOrigin(Base=simplify(graft(evalsrf_4.Frame)), Origin=simplify(curvepoint_4))
neg_7 = Negative(Value=number_slider_16)
dom_7 = ConstructDomain(DomainStart=expr("x/2", number_slider_16), DomainEnd=expr("x/2", neg_7))
Z_11 = UnitZ(Factor=expr("x+0.2", number_slider_20))
rectangle_6 = Rectangle(Plane=pl_origin_3, XSize=number_slider_19, YSize=dom_7, Radius=0)  # -> Rectangle, Length
rectangle_7 = Rectangle(Plane=pl_origin_3, XSize=number_slider_20, YSize=dom_7, Radius=0)  # -> Rectangle, Length
move_9 = Move(Geometry=rectangle_6.Rectangle, Motion=Z_11)  # -> Geometry, Transform
srfsplit_3 = SurfaceSplit(Surface=srf_23, Curves=[rectangle_7.Rectangle, move_9.Geometry])
area_16 = Area(Geometry=[rectangle_7.Rectangle, move_9.Geometry])  # -> Area, Centroid
area_17 = Area(Geometry=srfsplit_3)  # -> Area, Centroid
fsim_6 = FindSimilarMember(Data=area_16.Centroid, Set=area_17.Centroid)  # -> Hit, Index

# ---- group: contour fenetre
brep_8 = Brep(join_11.Breps)

# ---- group: murs
srf_24 = Surface(cull_i_5)

# ---- group: profondeur fenetre
brep_9 = Brep(loft_6)

# ---- group: rideau
srf_25 = Surface([dispatch_7.ListB, offset_11])

# ----
crv_13 = Curve(intcrv.Curve)
boundary_3 = BoundarySurfaces(Edges=rectangle_7.Rectangle)

# ---- group: Structure
merge_10 = Merge(Data1=brep_2, Data2=brep_5)

# ---- group: murs exterieur
merge_11 = Merge(Data1=srf_10, Data2=srf_9, Data3=brep_6, Data4=srf_24, Data5=brep_3)

# ---- group: fenetres
merge_12 = Merge(Data2=srf_25, Data3=brep_8, Data4=brep_9)

# ----
join_12 = BrepJoin(Breps=flatten(merge_2))  # -> Breps, Closed
join_13 = BrepJoin(Breps=flatten(merge_11))  # -> Breps, Closed
fmerge_2 = MergeFaces(Brep=join_12.Breps)  # -> Breps, Before, After
fmerge_3 = MergeFaces(Brep=join_13.Breps)  # -> Breps, Before, After

wires_11 = BrepWireframe(Brep=srf_17, Density=-1)
wires_12 = BrepWireframe(Brep=brep_3, Density=-1)

area_18 = Area(Geometry=rectangle.Rectangle)  # -> Area, Centroid
multiplication = Multiplication(A=area_18.Area, B=land_price_m²)
cull_i_8 = CullIndex(List=move.Geometry, Indices="0", Wrap=True)
merge_13 = Merge(Data1=cull_i_8, Data2=rectangle.Rectangle)  # -> flatten(Result)
addition_2 = Addition(A=structure_shell_price_m², B=interior_finishing_price_m²)

area_19 = Area(Geometry=merge_13)  # -> Area, Centroid
ma = MassAddition(Input=area_19.Area)  # -> Result, PartialResults

# ---- group: RH_OUT:area
data_2 = Data(ma.Result)

# ----
multiplication_2 = Multiplication(A=ma.Result, B=addition_2)
addition_3 = Addition(A=multiplication, B=multiplication_2)
multiplication_3 = Multiplication(A=selling_price_m², B=ma.Result)

# ---- group: RH_OUT:price1
data_3 = Data(multiplication_3)

# ---- group: RH_OUT:price
data_4 = Data(addition_3)

# ----
subtraction = Subtraction(A=data_3, B=data_4)

division_2 = Division(A=addition_3, B=multiplication_3)

# ---- group: RH_OUT:price2
data_5 = Data(subtraction)

# ----
multiplication_4 = Multiplication(A=division_2, B=Slider(100, range=0..100))
expression = Expression(x=multiplication_4, Expression="if(x>100,-x,x)")
larger_3 = LargerThan(FirstNumber=multiplication_4, SecondNumber="100")  # -> LargerThan, OrEqualTo
round = Round(Number=expression)  # -> Nearest, Floor, Ceiling
panel_5 = Panel(round.Nearest)

# ---- group: RH_OUT:price3
data_6 = Data(round.Nearest)

# ----
srf_26 = Surface(merge_4)
wires_13 = BrepWireframe(Brep=srf_26, Density=-1)
offset_13 = OffsetSurface(Surface=srf_26, Distance=0, Retrim=True)
Z_12 = UnitZ(Factor=number_slider_14)
item_18 = ListItem(List=wires_13, Index=Slider(3, range=0..10), Wrap=True)
srf_27 = Surface(offset_13)
extr_11 = Extrude(Base=item_18, Direction=Z_12)
wires_14 = BrepWireframe(Brep=srf_27, Density=-1)
area_20 = Area(Geometry=srf_27)  # -> Area, Centroid
offset_14 = OffsetSurface(Surface=extr_11, Distance=neg, Retrim=True)
evalsrf_5 = EvaluateSurface(Surface=srf_27, Point=area_20.Centroid)  # -> Point, Normal, UDirection, VDirection, Frame
item_19 = ListItem(List=wires_14, Index=Slider(3, range=0..10), Wrap=True)
loft_8 = Loft(
    Curves=[extr_11, offset_14],
    Options={Adjust=True, Closed=False, LoftEnds=0, LoftSimp=0, LoftType=0, Rebuild=10, Refit=0.01})
curvepoint_5 = PointOnCurve(item_19, parameter=0.5)
debrep_4 = DeconstructBrep(Brep=loft_8)  # -> Faces, Edges, Vertices
pl_origin_4 = PlaneOrigin(Base=simplify(graft(evalsrf_5.Frame)), Origin=simplify(curvepoint_5))
rectangle_8 = Rectangle(Plane=pl_origin_4, XSize=number_slider_21, YSize=Domain(-2, 2), Radius=0)  # -> Rectangle, Length
srfsplit_4 = SurfaceSplit(Surface=srf_27, Curves=rectangle_8.Rectangle)
area_21 = Area(Geometry=rectangle_8.Rectangle)  # -> Area, Centroid
area_22 = Area(Geometry=srfsplit_4)  # -> Area, Centroid
fsim_7 = FindSimilarMember(Data=area_21.Centroid, Set=area_22.Centroid)  # -> Hit, Index
cull_i_9 = CullIndex(List=srfsplit_4, Indices=fsim_7.Index, Wrap=True)
item_20 = ListItem(List=srfsplit_4, Index=fsim_7.Index, Wrap=True)
srf_28 = Surface(item_20)
srf_29 = Surface(cull_i_9)
offset_15 = OffsetSurface(Surface=srf_28, Distance=Slider(1, range=0..1), Retrim=True)
loft_9 = Loft(
    Curves=[offset_15, srf_28],
    Options={Adjust=True, Closed=False, LoftEnds=0, LoftSimp=0, LoftType=0, Rebuild=10, Refit=0.01})
merge_14 = Merge(Data1=srf_29, Data2=loft_9)

item_21 = ListItem(List=debrep_4.Faces, Index=Slider(5, range=0..10), Wrap=True)
srf_30 = Surface(extr_11)
wires_15 = BrepWireframe(Brep=srf_29, Density=-1)
wires_16 = BrepWireframe(Brep=srf_30, Density=-1)
midpt = CurveMiddle(Curve=wires_15)
midpt_2 = CurveMiddle(Curve=wires_16)
pdecon_2 = Deconstruct(Point=midpt)  # -> XComponent, YComponent, ZComponent
pdecon_3 = Deconstruct(Point=midpt_2)  # -> XComponent, YComponent, ZComponent
sort_2 = SortList(Keys=pdecon_2.ZComponent, ValuesA=wires_15)  # -> Keys, ValuesA

merge_15 = Merge(Data1=extr_11, Data2=item_21)

sort_3 = SortList(Keys=pdecon_3.ZComponent, ValuesA=wires_16)  # -> Keys, ValuesA
item_22 = ListItem(List=sort_3.ValuesA, Index=0, Wrap=True)  # -> Item1, Item
cull_i_10 = CullIndex(List=sort_2.ValuesA, Indices=panel_2, Wrap=True)
crv_14 = Curve(item_22.Item1)
srf_31 = Surface(offset_15)
divide_5 = DivideDomain²(Domain=srf_31, UCount=Slider(1, range=0..10), VCount=Slider(18, range=0..100))
subsrf_4 = Isotrim(Surface=srf_31, Domain=divide_5)  # -> simplify(Surface)
untrim = Untrim(Surface=subsrf_4)
subsrf_5 = Isotrim(Surface=reparameterize(untrim), Domain=dom²num)
wires_17 = BrepWireframe(Brep=[fmerge_2.Breps, brep_5, merge_12, subsrf_5], Density=-1)  # -> flatten(Wireframe)
merge_16 = Merge(Data1=wires_17, Data2=flatten(wires_12), Data3=cull_i_10, Data4=crv_14)  # -> flatten(Result)
lng_2 = ListLength(List=flatten(merge_16))
repeat_3 = RepeatData(Data=swatch_3, Length=lng_2)
preview = CustomPreview(Geometry=merge_16, Material=swatch_3)
c_script = CSharpScript(crv=merge_16, color=repeat_3)  # -> out, A; inputs crv: Curve, color: Color
# ---------- c_script: C# ----------
    var c = color.R + "," + color.G + "," + color.B;
    crv.SetUserString("color", c);
    A = crv;
# ---------- end c_script ----------

# ---- group: RH_OUT:edges2
curve = Curve(flatten(c_script.A))

# ----
wires_18 = BrepWireframe(Brep=[item_16, boundary_3], Density=-1)
join_14 = JoinCurves(Curves=flatten(wires_18), Preserve=False)

boundary_4 = BoundarySurfaces(Edges=join_14)

divide_6 = DivideDomain²(Domain=boundary_4, UCount=Slider(1, range=0..10), VCount=Slider(14, range=0..100))
subsrf_6 = Isotrim(Surface=graft(boundary_4), Domain=divide_6)  # -> simplify(Surface)
crv_15 = Curve(subsrf_6)

json_output_for_grilles = Curve(flatten([crv_13, crv_15]))
merge_17 = Merge(Data1=wires_11, Data2=json_output_for_grilles)
crv_16 = Curve(flatten(merge_17))
explode_3 = Explode(Curve=crv_16, Recursive=True)  # -> flatten(Segments), Vertices
lng_3 = ListLength(List=flatten(explode_3.Segments))
repeat_4 = RepeatData(Data=swatch, Length=lng_3)
preview_2 = CustomPreview(Geometry=explode_3.Segments, Material=swatch)
c_script_2 = CSharpScript(crv=explode_3.Segments, color=repeat_4)  # -> out, A; inputs crv: Curve, color: Color; same code as c_script

# ---- group: RH_OUT:edges
curve_2 = Curve(flatten(c_script_2.A))

# ----
cull_i_11 = CullIndex(List=srfsplit_3, Indices=fsim_6.Index, Wrap=True)  # -> flatten(List)
item_23 = ListItem(List=srfsplit_3, Index=fsim_6.Index, Wrap=True)  # -> flatten(Item)
srf_32 = Surface(cull_i_11)
wires_19 = BrepWireframe(Brep=item_23, Density=-1)
explode_4 = Explode(Curve=wires_19, Recursive=True)  # -> Segments, Vertices
wires_20 = BrepWireframe(Brep=srf_32, Density=-1)
dupln_3 = RemoveDuplicateLines(Lines=flatten(explode_4.Segments), Tolerance=0.01)
explode_5 = Explode(Curve=wires_20, Recursive=True)  # -> Segments, Vertices
join_15 = JoinCurves(Curves=dupln_3, Preserve=False)
dupln_4 = RemoveDuplicateLines(Lines=flatten(explode_5.Segments), Tolerance=0.01)
join_16 = JoinCurves(Curves=dupln_4, Preserve=False)
boundary_5 = BoundarySurfaces(Edges=join_15)
offset_16 = OffsetSurface(Surface=boundary_5, Distance=Slider(0.23, range=0..1), Retrim=True)
boundary_6 = BoundarySurfaces(Edges=join_16)

wires_21 = BrepWireframe(Brep=boundary_5, Density=-1)
join_17 = JoinCurves(Curves=wires_21, Preserve=False)
wires_22 = BrepWireframe(Brep=offset_16, Density=-1)
join_18 = JoinCurves(Curves=wires_22, Preserve=False)
clean = CleanTree(RemoveNulls=True, RemoveInvalid=True, RemoveEmpty=False, Tree=join_17)

crv_17 = Curve(join_18)
srf_33 = Surface(join_18)

clean_2 = CleanTree(RemoveNulls=True, RemoveInvalid=True, RemoveEmpty=False, Tree=crv_17)

merge_18 = Merge(Data1=graft(clean), Data2=graft(clean_2))
loft_10 = Loft(Curves=merge_18, Options={Adjust=True, Closed=False, LoftEnds=0, LoftSimp=0, LoftType=0, Rebuild=10, Refit=0.01})
merge_19 = Merge(Data1=simplify(boundary_6), Data2=simplify(loft_10))
brep_10 = Brep(merge_19)

merge_20 = Merge(
    Data1=fmerge_2.Breps,
    Data2=fmerge_3.Breps,
    Data3=merge_10,
    Data4=merge_12,
    Data5=[brep_7, srf_22, brep_10, srf_33],
    Data6=[merge_14, merge_15],
    Data7=subsrf_5)  # -> flatten(Result)
mesh_2 = MeshBrep(
    Brep=merge_20,
    Settings={GridMaxCount=0, GridMinCount=16, JaggedSeams=False, MaxEdgeLength=0, MinEdgeLength=0.0001, MinTolerance=0, Refine=True, RefineAngle=0, RelativeTolerance=0.65, SimplePlanes=True, Tolerance=0})  # -> flatten(Mesh)
panel_6 = Panel("0,99,65")
swatch_4 = ColourSwatch(SwatchColor=RGB(255, 255, 255))
swatch_5 = ColourSwatch(SwatchColor=RGB(255, 255, 255))
mjoin = MeshJoin(Meshes=[mesh_2, ungroup])
mcol = MeshColours(Mesh=mjoin, Colours=ColourSwatch(SwatchColor=RGB(194, 167, 167)))

# ---- group: RH_OUT:mesh
mesh_3 = Mesh(flatten(mjoin))
