# Grasshopper definition MMM_FINAL_PAGE_0.1.gh (Grasshopper 1.0.7)
# plug-ins: Pufferfish

# INPUTS
rectangle_lenght = Slider(12, range=0..100)
rectangle_width = Slider(12, range=0..100)

get_number = GetNumber(rectangle_lenght, AtLeast=1, AtMost=1, Maximum=1.797693135e+308, Minimum=-1.797693135e+308, TreeAccess=False)
get_number_2 = GetNumber(rectangle_width, AtLeast=1, AtMost=1, Maximum=1.797693135e+308, Minimum=-1.797693135e+308, TreeAccess=False)
rectangle = Rectangle(Plane=PlaneXY(0, 0, 0), XSize=get_number, YSize=get_number_2, Radius=0)  # -> Rectangle, Length

ground_floor_curve = Curve(flatten(rectangle.Rectangle))
area = Area(Geometry=rectangle.Rectangle)  # -> Area, Centroid
distance_between_windows = Slider(1.1, range=1..10)
upper_levels_street_offset = Slider(1, range=0..5)
merge = Merge(Data1=Toggle(True), Data2=Toggle(False), Data3=Toggle(False), Data4=Toggle(False))
ground_level_height = Slider(4, range=0..5)
structural_grid_span = Slider(4, range=3..6)
height_upper_levels = Slider(3.3, range=2.8..4)
door_type_wip = Slider(3, range=0..10)
number_of_floors = Slider(2, range=0..4)
column_sections = Slider(0.12, range=0.12..0.16)
railing_height = Slider(0.8, range=0..2)
cluster = Cluster(
    section_poteau_2=column_sections,
    corbeling_2=upper_levels_street_offset,
    facade_or_not=merge,
    hauteur_garde_corps=railing_height,
    curve=ground_floor_curve,
    hight_ground_levels=ground_level_height,
    grid_strructure=structural_grid_span,
    hight_up_levels_2=height_upper_levels,
    number_of_floors=number_of_floors,
    espacement_fenetre=distance_between_windows,
    door_type=door_type_wip)  # -> dalles, structure, murs, brep_brick, brep_concrete, rectangle_door, plane_door, rectangle_garage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
ungroup = Ungroup(Group=cluster.dalles)  # -> flatten(Objects)
area_2 = Area(Geometry=ungroup)  # -> Area, Centroid
pdecon = Deconstruct(Point=area_2.Centroid)  # -> XComponent, YComponent, ZComponent
number_slider = Slider(1, range=0..10)
brep = Brep(cluster.brep_concrete)
curve = Curve(cluster.rectangle_window)
plane = Plane(cluster.plane_window)
sort = SortList(Keys=pdecon.ZComponent, ValuesA=ungroup)  # -> Keys, ValuesA
list_item = ListItem(List=flatten(curve), Index=number_slider, Wrap=True)
list_item_2 = ListItem(List=flatten(plane), Index=number_slider, Wrap=True)
explode = Explode(Curve=list_item, Recursive=True)  # -> Segments, Vertices
item = ListItem(List=sort.ValuesA, Index=0, Wrap=True)  # -> Item, Item1
deconstruct_plane = DeconstructPlane(Plane=list_item_2)  # -> Origin, XAxis, YAxis, ZAxis
merge_2 = Merge(Data1=brep, Data2=flatten(cluster.murs))
data = Data(flatten(cluster.grillage))
negative = Negative(Value=deconstruct_plane.ZAxis)
ungroup_2 = Ungroup(Group=data)  # -> flatten(Objects)
debrep = DeconstructBrep(Brep=item.Item)  # -> Faces, Edges, Vertices
debrep_2 = DeconstructBrep(Brep=item.Item1)  # -> Faces, Edges, Vertices
number_slider_2 = Slider(0.1, range=0..1)
list_item_3 = ListItem(List=flatten(explode.Segments), Index=0, Wrap=True)  # -> Item, Item1, Item2, Item3
amplitude = Amplitude(Vector=negative, Amplitude=Slider(0.2, range=0..1))
curve_2 = Curve(graft(list_item_3.Item))
number_slider_3 = Slider(21, range=0..100)
move = Move(Geometry=list_item, Motion=amplitude)  # -> Geometry, Transform
area_3 = Area(Geometry=debrep.Faces)  # -> Area, Centroid
area_4 = Area(Geometry=debrep_2.Faces)  # -> Area, Centroid
offset_curve = OffsetCurve(Curve=[list_item_3.Item, list_item_3.Item1, list_item_3.Item3], Distance=number_slider_2, Plane=list_item_2, Corners=1)
offset_curve_2 = OffsetCurve(Curve=list_item_3.Item2, Distance=Slider(0.57, range=0..1), Plane=list_item_2, Corners=1)
plane_2 = Plane(flatten(cluster.plane_door))
curve_3 = Curve(flatten(cluster.rectangle_door))
pdecon_2 = Deconstruct(Point=area_3.Centroid)  # -> XComponent, YComponent, ZComponent
pdecon_3 = Deconstruct(Point=area_4.Centroid)  # -> XComponent, YComponent, ZComponent
surface = Surface(move.Geometry)
bounding_rectangle = BoundingRectangle(Geometry=flatten([offset_curve, offset_curve_2]), Plane=list_item_2, Axis=0, Slide=0, Union=True)  # -> Bounding, DimensionX, DimensionY
divide_curve = DivideCurve(Curve=curve_2, Count=number_slider_3, Kinks=False)  # -> Points, Tangents, Parameters
divide_curve_2 = DivideCurve(Curve=list_item_3.Item2, Count=number_slider_3, Kinks=False)  # -> reverse(Points), Tangents, Parameters
divide_domain² = DivideDomain²(Domain=surface, UCount=Slider(1, range=0..1), VCount=Slider(18, range=0..100))
null_item = NullItem(Item=plane_2)  # -> NullFlags, InvalidFlags, Description
sort_2 = SortList(Keys=pdecon_2.ZComponent, ValuesA=debrep.Faces)  # -> Keys, ValuesA
sort_3 = SortList(Keys=pdecon_3.ZComponent, ValuesA=debrep_2.Faces)  # -> Keys, ValuesA
item_2 = ListItem(List=sort_2.ValuesA, Index=0, Wrap=True)
item_3 = ListItem(List=sort_3.ValuesA, Index=0, Wrap=True)
dispatch = Dispatch(List=curve_3, DispatchPattern=null_item.NullFlags)  # -> ListA, ListB
isotrim = Isotrim(Surface=graft(surface), Domain=divide_domain²)
loft = Loft(
    Curves=flatten([bounding_rectangle.Bounding, list_item]),
    Options={Adjust=False, Closed=False, LoftEnds=0, LoftSimp=0, LoftType=0, Rebuild=10, Refit=0.01})
dispatch_2 = Dispatch(List=plane_2, DispatchPattern=null_item.NullFlags)  # -> ListA, ListB
line = Line(StartPoint=divide_curve.Points, EndPoint=divide_curve_2.Points)
area_5 = Area(Geometry=item_2)  # -> Area, Centroid
area_6 = Area(Geometry=item_3)  # -> Area, Centroid
amplitude_2 = Amplitude(Vector=deconstruct_plane.ZAxis, Amplitude=number_slider_2)
merge_faces = MergeFaces(Brep=loft)  # -> Breps, Before, After
area_7 = Area(Geometry=isotrim)  # -> Area, Centroid
explode_2 = Explode(Curve=dispatch.ListB, Recursive=True)  # -> Segments, Vertices
list_length = ListLength(List=line)
deconstruct_plane_2 = DeconstructPlane(Plane=dispatch_2.ListB)  # -> Origin, XAxis, YAxis, ZAxis
extrude = Extrude(Base=merge_faces.Breps, Direction=amplitude_2)
amplitude_3 = Amplitude(Vector=graft(deconstruct_plane.ZAxis), Amplitude=Slider(0.01, range=0..0.1))
scale_nu = ScaleNU(Geometry=isotrim, Plane=area_7.Centroid, ScaleX=1, ScaleY=1, ScaleZ=Slider(0.95, range=0..1))  # -> Geometry, Transform
list_item_4 = ListItem(List=explode_2.Segments, Index=0, Wrap=True)  # -> Item, Item1, Item2, Item3
subtraction = Subtraction(A=list_length, B=Slider(1, range=0..1))
join_curves = JoinCurves(Curves=flatten([list_item_4.Item1, list_item_4.Item2, list_item_4.Item3]), Preserve=False)  # -> flatten(Curves)
amplitude_4 = Amplitude(Vector=deconstruct_plane_2.ZAxis, Amplitude=Slider(0.1, range=0..1))
negative_2 = Negative(Value=Slider(0.01, range=0..0.1))
negative_3 = Negative(Value=deconstruct_plane_2.ZAxis)
negative_4 = Negative(Value=Slider(0, range=0..1))
offset_curve_3 = OffsetCurve(Curve=join_curves, Distance=negative_2, Corners=1)
extrude_2 = Extrude(Base=scale_nu.Geometry, Direction=amplitude_3)
offset_curve_4 = OffsetCurve(Curve=offset_curve_3, Distance=negative_4, Corners=1)  # -> graft(Curve)
amplitude_5 = Amplitude(Vector=negative_3, Amplitude=Slider(1, range=0..10))
offset_curve_5 = OffsetCurve(Curve=offset_curve_3, Distance=Slider(0.2, range=0..1), Corners=1)
cull_index = CullIndex(List=line, Indices=[list_length, subtraction], Wrap=True)
move_2 = Move(Geometry=offset_curve_4, Motion=amplitude_5)  # -> graft(Geometry), Transform
loft_2 = Loft(
    Curves=flatten([offset_curve_3, offset_curve_5]),
    Options={Adjust=False, Closed=False, LoftEnds=0, LoftSimp=0, LoftType=0, Rebuild=10, Refit=0.01})
extrude_3 = Extrude(Base=offset_curve_3, Direction=amplitude_5)
curve_4 = Curve(loft_2)
explode_3 = Explode(Curve=move_2.Geometry, Recursive=True)  # -> flatten(Segments), Vertices
move_3 = Move(Geometry=loft_2, Motion=amplitude_4)  # -> Geometry, Transform
extrude_4 = Extrude(Base=curve_4, Direction=amplitude_4)
divide_curve_3 = DivideCurve(Curve=cull_index, Count=Slider(5, range=0..10), Kinks=False)  # -> Points, Tangents, Parameters
loft_3 = Loft(
    Curves=flatten([offset_curve_3, move_2.Geometry]),
    Options={Adjust=False, Closed=False, LoftEnds=0, LoftSimp=0, LoftType=0, Rebuild=10, Refit=0.01})
list_item_5 = ListItem(List=divide_curve_3.Points, Index=Slider(1, range=0..10), Wrap=True)
brep_join = BrepJoin(Breps=flatten([extrude_4, move_3.Geometry, loft_3]))  # -> Breps, Closed
list_item_6 = ListItem(List=explode_3.Segments, Index=0, Wrap=True)  # -> Item, Item1, Item2
distance = Distance(PointA=list_item_5, PointB=divide_curve_3.Points)
loft_4 = Loft(
    Curves=flatten([list_item_6.Item, list_item_6.Item2]),
    Options={Adjust=True, Closed=False, LoftEnds=0, LoftSimp=0, LoftType=0, Rebuild=10, Refit=0.01})
merge_faces_2 = MergeFaces(Brep=flatten(brep_join.Breps))  # -> Breps, Before, After
graph_mapper = GraphMapper(distance, x0=0, x1=1, y0=0, y1=1, container_name="Bezier", cpx=[0, 0, 0.4959716797, 1], cpy=[0, 1, 1, 0.7272896171])
merge_3 = Merge(Data1=merge_faces_2.Breps, Data2=loft_4)
construct_domain = ConstructDomain(DomainStart=Slider(0.18, range=0..1), DomainEnd=Slider(0, range=0..1))
bounds = Bounds(Numbers=graph_mapper)
remap_numbers = RemapNumbers(Value=graph_mapper, Source=bounds, Target=construct_domain)  # -> Mapped, Clipped
amplitude_6 = Amplitude(Vector=deconstruct_plane.ZAxis, Amplitude=remap_numbers.Mapped)
move_4 = Move(Geometry=simplify(divide_curve_3.Points), Motion=simplify(amplitude_6))  # -> Geometry, Transform
interpolate = Interpolate(Vertices=move_4.Geometry, Degree=3, Periodic=False, KnotStyle=1)  # -> Curve, Length, Domain
amplitude_7 = Amplitude(Vector=deconstruct_plane.ZAxis, Amplitude=Slider(0.04, range=0..0.1))
move_5 = Move(Geometry=interpolate.Curve, Motion=amplitude_7)  # -> Geometry, Transform
pipe = Pipe(Curve=move_5.Geometry, Radius=Slider(0.005, range=0..0.01), Caps=0)
merge_4 = Merge(Data1=extrude_2, Data2=pipe, Data3=extrude)  # -> flatten(Result)
group = Group(Objects=merge_4)
mesh = MeshBrep(
    Brep=merge_3,
    Settings={GridMaxCount=0, GridMinCount=16, JaggedSeams=False, MaxEdgeLength=0, MinEdgeLength=0.0001, MinTolerance=0, Refine=True, RefineAngle=0, RelativeTolerance=0.65, SimplePlanes=True, Tolerance=0})
orient = Orient(Geometry=group, Source=list_item_2, Target=plane)  # -> Geometry, Transform
clean = CleanTree(RemoveNulls=True, RemoveInvalid=True, RemoveEmpty=False, Tree=orient.Geometry)
mesh_2 = MeshBrep(
    Brep=merge_2,
    Settings={GridMaxCount=0, GridMinCount=16, JaggedSeams=False, MaxEdgeLength=0, MinEdgeLength=0.0001, MinTolerance=0, Refine=True, RefineAngle=0, RelativeTolerance=0.65, SimplePlanes=True, Tolerance=0})
ungroup_3 = Ungroup(Group=clean)
mesh_3 = MeshBrep(
    Brep=ungroup_3,
    Settings={GridMaxCount=0, GridMinCount=16, JaggedSeams=False, MaxEdgeLength=0, MinEdgeLength=0.0001, MinTolerance=0, Refine=True, RefineAngle=0, RelativeTolerance=0.65, SimplePlanes=True, Tolerance=0})
merge_5 = Merge(Data1=mesh_2, Data2=flatten(mesh_3), Data3=mesh)
crv = Curve(ungroup_2)
group_2 = Group(Objects=merge_5)
explode_4 = Explode(Curve=crv, Recursive=True)  # -> flatten(Segments), Vertices
bbox = BoundingBox(Content=group_2, Plane=PlaneXY(0, 0, 0))  # -> Box, Box_2
ungroup_4 = Ungroup(Group=merge_5)  # -> flatten(Objects)
group_3 = Group(Objects=explode_4.Segments)
debrep_3 = DeconstructBrep(Brep=bbox.Box)  # -> Faces, Edges, Vertices
pt = Point(Point(0, 0, 0))
area_8 = Area(Geometry=debrep_3.Faces)  # -> Area, Centroid
pdecon_4 = Deconstruct(Point=area_8.Centroid)  # -> XComponent, YComponent, ZComponent
sort_4 = SortList(Keys=pdecon_4.ZComponent, ValuesA=debrep_3.Faces)  # -> Keys, ValuesA
item_4 = ListItem(List=sort_4.ValuesA, Index=0, Wrap=True)
area_9 = Area(Geometry=item_4)  # -> Area, Centroid
move2pt = MoveToPoint(Geometry=group_2, PointA=area_9.Centroid, PointB=pt)  # -> Moved, Vector, Transform
move2pt_2 = MoveToPoint(Geometry=group_3, PointA=area_9.Centroid, PointB=pt)  # -> Moved, Vector, Transform
ungroup_5 = Ungroup(Group=move2pt_2.Moved)
ungroup_6 = Ungroup(Group=move2pt.Moved)
lng = ListLength(List=ungroup_5)
repeat = RepeatData(Data=ColourSwatch(SwatchColor=RGB(105, 105, 105)), Length=lng)
c_script = CSharpScript(crv=flatten(ungroup_5), color=repeat)  # -> out, A; inputs crv: Curve, color: Color
# ---------- c_script: C# ----------
    var c = color.R + "," + color.G + "," + color.B;
    crv.SetUserString("color", c);
    A = crv;
# ---------- end c_script ----------

# ---- group: RH_OUT:door_curve
curve_5 = Curve(flatten(c_script.A))

# ---- group: RH_OUT:gf_area
# OUTPUTS
data_2 = Data(area_5.Area)

# ---- group: RH_OUT:uf_area
data_3 = Data(area_6.Area)

# ---- group: RH_OUT:bigmesh
mesh_4 = Mesh(ungroup_6)

# ==== cluster Cluster

number_slider = Slider(5.123, range=2..20)
circle = Circle(Plane=PlaneXY(0, 0, 0), Radius=number_slider)
populate_geometry = PopulateGeometry(Geometry=circle, Count=Slider(4, range=4..6), Seed=number_slider)
convex_hull = ConvexHull(Points=populate_geometry, Plane=PlaneXY(0, 0, 0))  # -> Hull, HullZ, Indices
flip_curve = FlipCurve(Curve=convex_hull.Hull)  # -> Curve, Flag

curve = ClusterInput()

section_poteau = Slider(0.12, range=0.1..0.3)
section_poteau_2 = ClusterInput()
maximum = Maximum(A=section_poteau_2, B=Slider(0.1, range=0..0.1))

curve_2 = Curve(curve)
flip_curve_2 = FlipCurve(Curve=curve_2)  # -> Curve, Flag
explode = Explode(Curve=curve_2, Recursive=True)  # -> Segments, Vertices
number_slider_2 = Slider(1, range=0..1)
merge = Merge(Data1=curve_2, Data2=flip_curve_2.Curve)  # -> flatten(Result)
list_item = ListItem(List=explode.Segments, Index=0, Wrap=True)
negative = Negative(Value=number_slider_2)
offset_curve = OffsetCurve(Curve=list_item, Distance=negative, Corners=1)
offset_curve_2 = OffsetCurve(Curve=list_item, Distance=number_slider_2, Corners=1)
point_on_curve = PointOnCurve(offset_curve_2, parameter=0.5)
point_on_curve_2 = PointOnCurve(offset_curve, parameter=0.5)
point_in_curve = PointInCurve(Point=point_on_curve, Curve=curve_2)  # -> Relationship, Point
point_in_curve_2 = PointInCurve(Point=point_on_curve_2, Curve=curve_2)  # -> Relationship, Point
merge_2 = Merge(Data1=point_in_curve_2.Relationship, Data2=point_in_curve.Relationship)
cull_pattern = CullPattern(List=merge, CullPattern=merge_2)

espacement_fenetres = Slider(1.6, range=0..10)
espacement_fenetre = ClusterInput()
maximum_2 = Maximum(A=espacement_fenetre, B=Slider(1.9, range=0..10))

grid_structure = Slider(3.694, range=0..10)
grid_strructure = ClusterInput()
maximum_3 = Maximum(A=grid_strructure, B=Slider(3.5, range=3.5..10))

corbeling = Slider(1.49, range=0.01..10)
corbeling_2 = ClusterInput()
maximum_4 = Maximum(A=corbeling_2, B=Slider(0.1, range=0..0.1))

merge_3 = Merge(Data1=Toggle(False), Data2=Toggle(False), Data3=Toggle(True), Data4=Toggle(True))
facade_or_not = ClusterInput()

min_for_galerie = Slider(2.5, range=0..10)

larger_than = LargerThan(FirstNumber=min_for_galerie, SecondNumber=maximum_4)  # -> LargerThan, OrEqualTo
larger_than_2 = LargerThan(FirstNumber=maximum_4, SecondNumber=min_for_galerie)  # -> LargerThan, OrEqualTo

hight_ground_level = Slider(3.2, range=0..10)
hight_ground_levels = ClusterInput()
maximum_5 = Maximum(A=hight_ground_levels, B=Slider(3.2, range=0..10))

number_floors = Slider(3, range=0..10)
number_of_floors = ClusterInput()
maximum_6 = Maximum(A=number_of_floors, B=Slider(1, range=0..1))

hight_up_levels = Slider(3, range=0..10)
hight_up_levels_2 = ClusterInput()
maximum_7 = Maximum(A=hight_up_levels_2, B=Slider(3, range=0..10))

hauteur_garde_corps = ClusterInput()

hateur_garde_corps_terrasse = Slider(1, range=0..10)
maximum_8 = Maximum(A=hauteur_garde_corps, B=Slider(0.4, range=0..1))

unit_z = UnitZ(Factor=1)
addition = Addition(A=maximum_6, B=Slider(1, range=0..1))
series = Series(Start=maximum_5, Step=maximum_7, Count=maximum_6)
series_2 = Series(Start=maximum_5, Step=maximum_7, Count=addition)
multiplication = Multiplication(A=maximum, B=Slider(2, range=0..10))
multiplication_2 = Multiplication(A=maximum_7, B=maximum_6)
subtraction = Subtraction(A=maximum_7, B=multiplication)
addition_2 = Addition(A=multiplication_2, B=maximum_5)
subtraction_2 = Subtraction(A=maximum_5, B=multiplication)
addition_3 = Addition(A=series, B=multiplication)
subtraction_3 = Subtraction(A=subtraction, B=multiplication)
addition_4 = Addition(A=addition_2, B=multiplication)
addition_5 = Addition(A=addition_4, B=maximum_8)
unit_z_2 = UnitZ(Factor=addition_4)
unit_z_3 = UnitZ(Factor=addition_2)
unit_z_4 = UnitZ(Factor=addition_5)
unit_z_5 = UnitZ(Factor=subtraction_3)
unit_z_6 = UnitZ(Factor=addition_3)
unit_z_7 = UnitZ(Factor=subtraction_2)
unit_z_8 = UnitZ(Factor=series_2)
unit_z_9 = UnitZ(Factor=unit_z_8)
curve_3 = Curve([<curve referenced from the Rhino model> x321])
curve_4 = Curve([<curve referenced from the Rhino model> x1463])
curve_5 = Curve([<curve referenced from the Rhino model> x4069])
curve_6 = Curve([<curve referenced from the Rhino model> x472])
curve_7 = Curve([<curve referenced from the Rhino model> x5000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])
curve_8 = Curve([<curve referenced from the Rhino model> x386])
curve_9 = Curve([<curve referenced from the Rhino model> x285])
curve_10 = Curve([<curve referenced from the Rhino model> x5000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])
group = Group(Objects=curve_3)
group_2 = Group(Objects=curve_4)
group_3 = Group(Objects=curve_5)
group_4 = Group(Objects=curve_6)
group_5 = Group(Objects=curve_7)
group_6 = Group(Objects=curve_8)
group_7 = Group(Objects=curve_9)
group_8 = Group(Objects=curve_10)
merge_4 = Merge(Data1=group, Data2=group_2, Data3=group_3, Data4=group_5, Data5=group_4, Data6=group_6, Data7=group_7, Data8=group_8)
bounding_rectangle = BoundingRectangle(Geometry=graft(merge_4), Plane=PlaneXY(0, 0, 0), Axis=0, Slide=0, Union=True)  # -> flatten(Bounding), DimensionX, DimensionY
number_slider_3 = Slider(2, range=0..10)
door_type = ClusterInput()
list_item_2 = ListItem(List=merge_4, Index=door_type, Wrap=True)
list_item_3 = ListItem(List=bounding_rectangle.Bounding, Index=door_type, Wrap=True)
explode_2 = Explode(Curve=list_item_3, Recursive=True)  # -> Segments, Vertices
area = Area(Geometry=list_item_3)  # -> Area, Centroid
list_item_4 = ListItem(List=explode_2.Segments, Index=0, Wrap=True)  # -> Item, Item1
curve_11 = Curve(list_item_4.Item1)
plane_origin = PlaneOrigin(Base=area.Centroid, Origin=area.Centroid)
length = Length(Curve=list_item_4.Item)
length_2 = Length(Curve=curve_11)
number_slider_4 = Slider(1, range=0..1)
surface = Surface(curve_2)
unit_z_10 = UnitZ(Factor=subtraction_2)
unit_z_11 = UnitZ(Factor=subtraction_3)
unit_z_12 = UnitZ(Factor=series)  # -> graft(UnitVector)
area_2 = Area()  # -> Area, Centroid; disabled
construct_point = ConstructPoint(XCoordinate=0, YCoordinate=0, ZCoordinate=0)  # disabled
unit_z_13 = UnitZ(Factor=multiplication)
number_slider_5 = Slider(46, range=0..100)  # disabled
unit_z_14 = UnitZ(Factor=multiplication)
unit_z_15 = UnitZ(Factor=maximum_8)
number_slider_6 = Slider(23, range=0..100)  # disabled
series_3 = Series(Start=0, Step=1, Count=number_slider_5)  # disabled

offset_curve_3 = OffsetCurve(Curve=cull_pattern, Distance=expr("-x", maximum), Corners=1)
explode_3 = Explode(Curve=offset_curve_3, Recursive=True)  # -> Segments, Vertices
list_item_5 = ListItem(List=explode_3.Segments, Index=0, Wrap=True)  # -> Item, Item1, Item2, Item3
merge_5 = Merge(Data1=list_item_5.Item, Data2=list_item_5.Item2)
merge_6 = Merge(Data1=list_item_5.Item1, Data2=list_item_5.Item3)
sort_list = SortList(Keys=merge_5, ValuesValuesA=merge_5)  # -> Keys, ValuesValuesA
list_item_6 = ListItem(List=sort_list.Keys, Index=0, Wrap=True)
division = Division(A=list_item_6, B=maximum_3)
surface_2 = Surface(offset_curve_3)
surface_3 = Surface(offset_curve_3)

sort_list_2 = SortList(Keys=merge_6, ValuesValuesA=merge_6)  # -> Keys, ValuesValuesA

list_item_7 = ListItem(List=sort_list_2.Keys, Index=0, Wrap=True)
division_2 = Division(A=list_item_7, B=maximum_3)
merge_7 = Merge(Data1=division, Data2=division_2, Data3=division, Data4=division_2)
divide_domain² = DivideDomain²(Domain=surface_2, UCount=division, VCount=division_2)
divide_surface = DivideSurface(Surface=surface_3, UCount=division, VCount=division_2)  # -> flatten(Points), Normals, Parameters
isotrim = Isotrim(Surface=surface_2, Domain=divide_domain²)

dispatch = Dispatch(List=merge_7, DispatchPattern=facade_or_not)  # -> ListA, ListB
dispatch_2 = Dispatch(List=explode_3.Segments, DispatchPattern=facade_or_not)  # -> ListA, ListB

dispatch_3 = Dispatch(List=merge_7, DispatchPattern=facade_or_not)  # -> ListA, ListB
join_curves = JoinCurves(Curves=dispatch_2.ListA, Preserve=False)  # -> simplify(graft(Curves))
divide_curve = DivideCurve(Curve=simplify(graft(dispatch_2.ListB)), Count=simplify(graft(dispatch.ListB)), Kinks=False)  # -> Points, Tangents, simplify(Parameters)
divide_curve_2 = DivideCurve(Curve=graft(dispatch_2.ListA), Count=graft(dispatch.ListA), Kinks=False)  # -> Points, Tangents, simplify(Parameters)
offset_curve_4 = OffsetCurve(Curve=join_curves, Distance=Slider(2, range=0..10), Corners=1)  # -> simplify(graft(Curve))
offset_curve_5 = OffsetCurve(Curve=join_curves, Distance=maximum_4, Corners=1)
loft = Loft(
    Curves=simplify(flatten([offset_curve_4, join_curves])),
    Options={Adjust=False, Closed=False, LoftEnds=0, LoftSimp=0, LoftType=0, Rebuild=10, Refit=0.01})

divide_curve_3 = DivideCurve(Curve=graft(merge_6), Count=division_2, Kinks=False)  # -> Points, Tangents, Parameters
divide_curve_4 = DivideCurve(Curve=graft(merge_5), Count=division, Kinks=False)  # -> Points, Tangents, Parameters
flip_matrix = FlipMatrix(Data=divide_curve_4.Points)
flip_matrix_2 = FlipMatrix(Data=divide_curve_3.Points)
list_item_8 = ListItem(List=flip_matrix, Index=0, Wrap=True)  # -> flatten(Item), flatten(Item1)
list_item_9 = ListItem(List=flip_matrix_2, Index=0, Wrap=True)  # -> flatten(Item), flatten(Item1)
reverse_list = ReverseList(List=list_item_8.Item1)
reverse_list_2 = ReverseList(List=list_item_9.Item1)
line = Line(StartPoint=list_item_8.Item, EndPoint=reverse_list)
line_2 = Line(StartPoint=list_item_9.Item, EndPoint=reverse_list_2)
end_points = EndPoints(Curve=flatten([line_2, line]))  # -> Start, End
merge_8 = Merge(Data1=end_points.Start, Data2=end_points.End)  # -> flatten(Result)
find_similar_member = FindSimilarMember(Data=merge_8, Set=divide_surface.Points)  # -> Hit, Index
cull_index = CullIndex(List=divide_surface.Points, Indices=find_similar_member.Index, Wrap=True)

extrude = Extrude(Base=loft)

curve_12 = Curve(line_2)
curve_closest_point = CurveClosestPoint(Point=cull_index, Curve=simplify(graft(curve_12)))  # -> Point, Parameter, Distance
number = Number(curve_closest_point.Distance)
larger_than_3 = LargerThan(FirstNumber=0.1, SecondNumber=number)  # -> LargerThan, OrEqualTo
cull_pattern_2 = CullPattern(List=curve_closest_point.Parameter, CullPattern=larger_than_3.LargerThan)
evaluate_curve = EvaluateCurve(Curve=graft(curve_12), Parameter=cull_pattern_2)  # -> flatten(Point), flatten(Tangent), Angle
unit_z_16 = UnitZ(Factor=1)
rotate = Rotate(Vector=evaluate_curve.Tangent, Axis=unit_z_16, Angle=degrees(-90))
move = Move(Geometry=evaluate_curve.Point, Motion=rotate)  # -> Geometry, Transform
line_sdl = LineSDL(Start=evaluate_curve.Point, Direction=evaluate_curve.Tangent, Length=1)

end_points_2 = EndPoints(Curve=join_curves)  # -> graft(Start), graft(End)
end_points_3 = EndPoints(Curve=offset_curve_5)  # -> graft(Start), graft(End)
line_3 = Line(StartPoint=end_points_2.Start, EndPoint=end_points_3.Start)
line_4 = Line(StartPoint=end_points_2.End, EndPoint=end_points_3.End)
merge_9 = Merge(Data1=end_points_3.Start, Data2=end_points_3.End)  # -> flatten(Result)
cull_duplicates = CullDuplicates(Points=merge_9, Tolerance=0.1, CullMode=3)  # -> Points, Indices, Valence
merge_10 = Merge(Data1=line_3, Data2=line_4)
list_length = ListLength(List=flatten(merge_10))
list_length_2 = ListLength(List=cull_duplicates.Points)
similarity = Similarity(FirstNumber=list_length_2, SecondNumber=list_length, Threshold=0.1)  # -> Similarity, AbsoluteDifference

evaluate_curve_2 = EvaluateCurve(Curve=simplify(graft(dispatch_2.ListA)), Parameter=divide_curve_2.Parameters)  # -> Point, Tangent, Angle
unit_z_17 = UnitZ(Factor=1)
rotate_2 = Rotate(Vector=evaluate_curve_2.Tangent, Axis=unit_z_17, Angle=degrees(-90))
amplitude = Amplitude(Vector=rotate_2, Amplitude=maximum_4)
move_2 = Move(Geometry=evaluate_curve_2.Point, Motion=amplitude)  # -> Geometry, Transform
line_sdl_2 = LineSDL(Start=evaluate_curve_2.Point, Direction=evaluate_curve_2.Tangent, Length=1)
line_5 = Line(StartPoint=evaluate_curve_2.Point, EndPoint=move_2.Geometry)
line_pt = LinePt(Line=line_sdl_2, Point=move_2.Geometry)

curve_13 = Curve(offset_curve_5)
offset_curve_6 = OffsetCurve(Curve=curve_13, Distance=maximum, Corners=1)
curve_closest_point_2 = CurveClosestPoint(Point=flatten(move_2.Geometry), Curve=offset_curve_6)  # -> Point, Parameter, Distance
shatter = Shatter(Curve=offset_curve_6, Parameters=curve_closest_point_2.Parameter)  # -> flatten(Segments)
explode_4 = Explode(Curve=shatter, Recursive=True)  # -> Segments, Vertices
negative_2 = Negative(Value=maximum)
extend_curve = ExtendCurve(Curve=explode_4.Segments, Type=0, Start=negative_2, End=negative_2)
stream_filter = StreamFilter(Gate=larger_than_2.LargerThan, Stream0=flatten(shatter), Stream1=flatten(extend_curve))
curve_14 = Curve(graft(stream_filter))
explode_5 = Explode(Curve=curve_14, Recursive=True)  # -> flatten(Segments), Vertices

curve_15 = Curve(simplify(graft(explode_5.Segments)))
number_slider_7 = Slider(2.2, range=0..10)
length_3 = Length(Curve=curve_15)
division_3 = Division(A=length_3, B=maximum_2)
divide_curve_5 = DivideCurve(Curve=curve_15, Count=simplify(graft(division_3)), Kinks=False)  # -> Points, Tangents, Parameters
number_slider_8 = Slider(0, range=0..100)
cull_index_2 = CullIndex(List=divide_curve_5.Points, Indices=number_slider_8, Wrap=True)
reverse_list_3 = ReverseList(List=cull_index_2)
cull_index_3 = CullIndex(List=reverse_list_3, Indices=number_slider_8, Wrap=True)
curve_closest_point_3 = CurveClosestPoint(Point=cull_index_3, Curve=curve_15)  # -> Point, Parameter, Distance
evaluate_curve_3 = EvaluateCurve(Curve=curve_15, Parameter=curve_closest_point_3.Parameter)  # -> Point, Tangent, Angle
unit_z_18 = UnitZ(Factor=1)
construct_plane = ConstructPlane(Origin=evaluate_curve_3.Point, XAxis=evaluate_curve_3.Tangent, YAxis=unit_z_18)  # -> simplify(Plane)
group_9 = Group(Objects=construct_plane)
data = Data(construct_plane)
move_3 = Move(Geometry=simplify(graft(group_9)), Motion=unit_z_6)  # -> simplify(Geometry), Transform
ungroup = Ungroup(Group=move_3.Geometry)

evaluate_curve_4 = EvaluateCurve(Curve=simplify(graft(dispatch_2.ListB)), Parameter=divide_curve.Parameters)  # -> Point, Tangent, Angle
unit_z_19 = UnitZ(Factor=1)
rotate_3 = Rotate(Vector=evaluate_curve_4.Tangent, Axis=unit_z_19, Angle=degrees(-90))
move_4 = Move(Geometry=evaluate_curve_4.Point, Motion=rotate_3)  # -> Geometry, Transform
line_sdl_3 = LineSDL(Start=evaluate_curve_4.Point, Direction=evaluate_curve_4.Tangent, Length=1)

number_slider_9 = Slider(1.4, range=0..10)
number_slider_10 = Slider(1.1, range=0..10)
number_slider_11 = Slider(0.2, range=0..1)
division_4 = Division(A=number_slider_10, B=Slider(2, range=0..10))
division_5 = Division(A=number_slider_11, B=Slider(2, range=0..10))
addition_6 = Addition(A=number_slider_9, B=Slider(0.2, range=0..1))
addition_7 = Addition(A=Slider(1, range=0..1), B=division_4)
addition_8 = Addition(A=addition_7, B=division_4, C=division_5)
unit_z_20 = UnitZ(Factor=addition_7)
unit_z_21 = UnitZ(Factor=addition_8)
construct_domain = ConstructDomain(DomainStart=expr("-x/2", number_slider_9), DomainEnd=expr("x/2", number_slider_9))
construct_domain_2 = ConstructDomain(DomainStart=expr("-x/2", number_slider_10), DomainEnd=expr("x/2", number_slider_10))
construct_domain_3 = ConstructDomain(DomainStart=expr("-x/2", addition_6), DomainEnd=expr("x/2", addition_6))
construct_domain_4 = ConstructDomain(DomainStart=expr("-x/2", number_slider_11), DomainEnd=expr("x/2", number_slider_11))
move_5 = Move(Geometry=ungroup, Motion=unit_z_20)  # -> Geometry, Transform
move_6 = Move(Geometry=ungroup, Motion=unit_z_21)  # -> Geometry, Transform
rectangle = Rectangle(Plane=move_6.Geometry, XSize=construct_domain_3, YSize=construct_domain_4, Radius=0)  # -> Rectangle, Length
rectangle_2 = Rectangle(Plane=move_5.Geometry, XSize=construct_domain, YSize=construct_domain_2, Radius=0)  # -> Rectangle, Length
merge_11 = Merge(Data1=rectangle_2.Rectangle, Data2=rectangle.Rectangle)
brep_join = BrepJoin(Breps=merge_11)  # -> Breps, Closed
merge_faces = MergeFaces(Brep=brep_join.Breps)  # -> Breps, Before, After
curve_16 = Curve(merge_faces.Breps)

cull_pattern_3 = CullPattern(List=merge_10, CullPattern=similarity.Similarity)
number_slider_12 = Slider(0, range=0..100)

# ---- group: poteau INTERIEUR
line_pt_2 = LinePt(Line=line_sdl, Point=move.Geometry)

# ---- group: poteau mitoyens
line_pt_3 = LinePt(Line=line_sdl_3, Point=move_4.Geometry)

# ----
extend_curve_2 = ExtendCurve(Curve=cull_pattern_3, Type=0, Start=expr("-X", section_poteau_2), End=maximum)
group_10 = Group(Objects=extend_curve_2)
group_11 = Group(Objects=cull_pattern_3)
merge_12 = Merge(Data1=group_10, Data2=group_11)
cull_pattern_4 = CullPattern(List=merge_12, CullPattern=[larger_than.OrEqualTo, larger_than_2.LargerThan])
ungroup_2 = Ungroup(Group=cull_pattern_4)

extend_curve_3 = ExtendCurve(Curve=line_5, Type=0, Start=Slider(0, range=0..100), End=expr("X-0.01", section_poteau_2))

shatter_2 = Shatter(Curve=simplify(graft(dispatch_2.ListB)), Parameters=divide_curve.Parameters)
extend_curve_4 = ExtendCurve(Curve=shatter_2, Type=0, Start=expr("-x", maximum), End=expr("-x", maximum))

curve_17 = Curve(flatten(extend_curve_4))
curve_18 = Curve(flatten(extend_curve_2))
merge_13 = Merge(Data1=curve_17, Data2=curve_18)

offset_curve_7 = OffsetCurve(Curve=curve_14, Distance=expr("-x", maximum), Corners=1)
merge_14 = Merge(Data1=flatten(offset_curve_7), Data2=merge_13)  # -> flatten(Result)
move_7 = Move(Geometry=merge_14, Motion=unit_z_2)  # -> simplify(graft(Geometry)), Transform
join_curves_2 = JoinCurves(Curves=flatten(move_7.Geometry), Preserve=False)  # -> simplify(graft(Curves))
offset_curve_8 = OffsetCurve(Curve=join_curves_2, Distance=expr("-x", maximum), Corners=1)  # -> simplify(Curve)
offset_curve_9 = OffsetCurve(Curve=join_curves_2, Distance=maximum, Corners=1)  # -> simplify(Curve)
loft_2 = Loft(
    Curves=[offset_curve_8, offset_curve_9],
    Options={Adjust=False, Closed=False, LoftEnds=0, LoftSimp=0, LoftType=0, Rebuild=10, Refit=0.01})
unit_z_22 = UnitZ(Factor=maximum_8)
extrude_2 = Extrude(Base=loft_2, Direction=unit_z_22)

construct_domain_5 = ConstructDomain(DomainStart=expr("-X", maximum), DomainEnd=maximum)
rectangle_3 = Rectangle(Plane=line_pt_3, XSize=construct_domain_5, YSize=construct_domain_5, Radius=0)  # -> flatten(Rectangle), Length
rectangle_4 = Rectangle(Plane=line_pt_2, XSize=construct_domain_5, YSize=construct_domain_5, Radius=0)  # -> flatten(Rectangle), Length

merge_15 = Merge(Data1=line_pt, Data2=line_pt_2, Data3=line_pt_3)
list_item_10 = ListItem(List=isotrim, Index=Slider(5, range=0..10), Wrap=True)
explode_6 = Explode(Curve=list_item_10, Recursive=True)  # -> Segments, Vertices
point = Point(merge_15)
cull_duplicates_2 = CullDuplicates(Points=explode_6.Vertices, Tolerance=0.1, CullMode=3)  # -> Points, Indices, Valence
find_similar_member_2 = FindSimilarMember(Data=graft(cull_duplicates_2.Points), Set=flatten(point))  # -> Hit, Index
list_item_11 = ListItem(List=flatten(merge_15), Index=find_similar_member_2.Index, Wrap=True)
move_8 = Move(Geometry=list_item_11, Motion=unit_z_2)  # -> simplify(graft(Geometry)), Transform
rectangle_5 = Rectangle(Plane=move_8.Geometry, XSize=construct_domain_5, YSize=construct_domain_5, Radius=0)  # -> flatten(Rectangle), Length

join_curves_3 = JoinCurves(Curves=dispatch_2.ListA, Preserve=False)
list_length_3 = ListLength(List=line_pt)
end_points_4 = EndPoints(Curve=join_curves_3)  # -> Start, End
subtraction_4 = Subtraction(A=list_length_3, B=1)  # -> flatten(Result)
find_similar_member_3 = FindSimilarMember(Data=[end_points_4.Start, end_points_4.End], Set=flatten(evaluate_curve_2.Point))  # -> Hit, Index
list_item_12 = ListItem(List=subtraction_4, Index=0, Wrap=True)
cull_index_4 = CullIndex(List=flatten(line_pt), Indices=flatten([find_similar_member_3.Index, list_item_12]), Wrap=True)
rectangle_6 = Rectangle(Plane=cull_index_4, XSize=construct_domain_5, YSize=construct_domain_5, Radius=0)  # -> Rectangle, Length

move_9 = Move(Geometry=list_item_10, Motion=unit_z_2)  # -> simplify(graft(Geometry)), Transform
explode_7 = Explode(Curve=move_9.Geometry, Recursive=True)  # -> Segments, Vertices
unit_z_23 = UnitZ(Factor=Slider(2.6, range=0..10))
move_10 = Move(Geometry=move_9.Geometry, Motion=unit_z_23)  # -> Geometry, Transform
extend_curve_5 = ExtendCurve(Curve=explode_7.Segments, Type=0, Start=expr("-x", maximum), End=expr("-x", maximum))
offset_curve_10 = OffsetCurve(Curve=extend_curve_5, Distance=expr("-x", maximum), Corners=1)
offset_curve_11 = OffsetCurve(Curve=extend_curve_5, Distance=maximum, Corners=1)
offset_curve_12 = OffsetCurve(Curve=move_10.Geometry, Distance=maximum, Corners=1)
surface_4 = Surface(offset_curve_12)
loft_3 = Loft(
    Curves=[offset_curve_10, offset_curve_11],
    Options={Adjust=False, Closed=False, LoftEnds=0, LoftSimp=0, LoftType=0, Rebuild=10, Refit=0.01})
unit_z_24 = UnitZ(Factor=expr("x*2", maximum))
extrude_3 = Extrude(Base=surface_4, Direction=unit_z_24)
extrude_4 = Extrude(Base=rectangle_5.Rectangle, Direction=unit_z_23)
extrude_5 = Extrude(Base=loft_3, Direction=unit_z_23)

merge_16 = Merge(Data1=offset_curve_5, Data2=flatten(dispatch_2.ListB), Data3=cull_pattern_3)  # -> flatten(Result)
join_curves_4 = JoinCurves(Curves=merge_16, Preserve=False)
offset_curve_13 = OffsetCurve(Curve=join_curves_4, Distance=maximum, Corners=1)
boundary_surfaces = BoundarySurfaces(Edges=offset_curve_13)
unit_z_25 = UnitZ(Factor=expr("x*2", maximum))
extrude_6 = Extrude(Base=boundary_surfaces, Direction=unit_z_25)
extrude_7 = Extrude(Base=surface, Direction=expr("-x", unit_z_25))
move_11 = Move(Geometry=extrude_6, Motion=unit_z_8)  # -> Geometry, Transform

merge_17 = Merge(Data1=line, Data2=line_2, Data3=extend_curve_3)
negative_3 = Negative(Value=maximum)
offset_curve_14 = OffsetCurve(Curve=merge_17, Distance=maximum, Corners=1)  # -> simplify(Curve)
offset_curve_15 = OffsetCurve(Curve=merge_17, Distance=negative_3, Corners=1)  # -> simplify(Curve)
unit_z_26 = UnitZ(Factor=expr("-x*2", maximum))
loft_4 = Loft(
    Curves=[offset_curve_14, offset_curve_15],
    Options={Adjust=False, Closed=False, LoftEnds=0, LoftSimp=0, LoftType=0, Rebuild=10, Refit=0.01})  # -> graft(Loft)
extrude_8 = Extrude(Base=loft_4, Direction=unit_z_26)  # -> flatten(Extrusion)
move_12 = Move(Geometry=extrude_8, Motion=graft(unit_z_8))  # -> Geometry, Transform

offset_curve_16 = OffsetCurve(Curve=merge_13, Distance=expr("-x", maximum), Corners=1)
offset_curve_17 = OffsetCurve(Curve=merge_13, Distance=maximum, Corners=1)
loft_5 = Loft(
    Curves=[offset_curve_17, offset_curve_16],
    Options={Adjust=True, Closed=False, LoftEnds=0, LoftSimp=0, LoftType=0, Rebuild=10, Refit=0.01})  # -> flatten(Loft)
extrude_9 = Extrude(Base=loft_5, Direction=unit_z_5)  # -> graft(Extrusion)
move_13 = Move(Geometry=extrude_9, Motion=unit_z_6)  # -> Geometry, Transform

curve_19 = Curve(extend_curve_4)
offset_curve_18 = OffsetCurve(Curve=curve_19, Distance=maximum, Corners=1)
offset_curve_19 = OffsetCurve(Curve=curve_19, Distance=expr("-x", maximum), Corners=1)
loft_6 = Loft(
    Curves=[offset_curve_18, offset_curve_19],
    Options={Adjust=False, Closed=False, LoftEnds=0, LoftSimp=0, LoftType=0, Rebuild=10, Refit=0.01})  # -> flatten(Loft)
extrude_10 = Extrude(Base=loft_6, Direction=unit_z_7)  # -> graft(Extrusion)

surface_5 = Surface([rectangle_4.Rectangle, rectangle_6.Rectangle])
extrude_11 = Extrude(Base=surface_5, Direction=unit_z_3)

group_12 = Group(Objects=flatten(extrude_7))
group_13 = Group(Objects=flatten(move_11.Geometry))
group_14 = Group(Objects=flatten(extrude_3))
group_15 = Group(Objects=flatten(extrude_11))
group_16 = Group(Objects=flatten(move_12.Geometry))
group_17 = Group(Objects=flatten(extrude_4))
group_18 = Group(Objects=flatten(move_13.Geometry))
group_19 = Group(Objects=flatten(extrude_2))
group_20 = Group(Objects=flatten(extrude_10))
group_21 = Group(Objects=flatten(extrude_5))
extrude_12 = Extrude(Base=surface_5, Direction=unit_z_10)
extrude_13 = Extrude(Base=surface_5, Direction=unit_z_11)
merge_18 = Merge(Data1=group_12, Data2=group_13, Data3=group_14)
ungroup_3 = Ungroup(Group=merge_18)
dalles = ClusterOutput(ungroup_3)

shatter_3 = Shatter(Curve=graft(dispatch_2.ListA), Parameters=divide_curve_2.Parameters)

offset_curve_20 = OffsetCurve(Curve=shatter_3, Distance=expr("x", maximum), Corners=1)

extend_curve_6 = ExtendCurve(Curve=offset_curve_20, Type=0, Start=expr("-x", maximum), End=expr("-x", maximum))  # -> flatten(Curve)

curve_20 = Curve(simplify(graft(extend_curve_6)))

length_4 = Length(Curve=curve_20)
division_6 = Division(A=length_4, B=maximum_2)
divide_curve_6 = DivideCurve(Curve=simplify(curve_20), Count=simplify(graft(division_6)), Kinks=False)  # -> simplify(Points), Tangents, Parameters
list_length_4 = ListLength(List=flatten(length_4))
list_length_5 = ListLength(List=divide_curve_6.Points)
repeat_data = RepeatData(Data=Slider(0, range=0..100), Length=flatten(list_length_4))  # -> simplify(Data)
subtraction_5 = Subtraction(A=list_length_5, B=Slider(1, range=0..1))  # -> simplify(Result)
cull_index_5 = CullIndex(List=divide_curve_6.Points, Indices=simplify(flatten([repeat_data, subtraction_5])), Wrap=True)
curve_closest_point_4 = CurveClosestPoint(Point=cull_index_5, Curve=curve_20)  # -> Point, Parameter, Distance
evaluate_curve_5 = EvaluateCurve(Curve=curve_20, Parameter=curve_closest_point_4.Parameter)  # -> Point, Tangent, Angle
unit_z_27 = UnitZ(Factor=1)
construct_plane_2 = ConstructPlane(Origin=evaluate_curve_5.Point, XAxis=evaluate_curve_5.Tangent, YAxis=unit_z_27)

list_length_6 = ListLength(List=flatten(construct_plane_2))
series_4 = Series(Start=0, Step=1, Count=list_length_6)
maximum_9 = Maximum(A=Slider(1, range=0..10), B=Slider(1, range=0..1))
data_2 = Data(construct_plane_2)
random_reduce = RandomReduce(List=series_4, Reduction=maximum_9, Seed=1)
data_3 = Data(flatten(data_2))
maximum_10 = Maximum(A=Slider(1, range=0..10), B=Slider(0, range=0..1))
list_item_13 = ListItem(List=series_4, Index=random_reduce, Wrap=True)
cull_index_6 = CullIndex(List=series_4, Indices=random_reduce, Wrap=True)
random_reduce_2 = RandomReduce(List=list_item_13, Reduction=maximum_10, Seed=1)
cull_index_7 = CullIndex(List=series_4, Indices=[random_reduce_2, cull_index_6], Wrap=True)
list_item_14 = ListItem(List=series_4, Index=[random_reduce_2, cull_index_6], Wrap=True)
replace_items = ReplaceItems(List=data_3, Indices=flatten([cull_index_7, cull_index_6]), Wrap=False)
replace_items_2 = ReplaceItems(List=data_3, Indices=list_item_13, Wrap=False)
replace_items_3 = ReplaceItems(List=data_3, Indices=list_item_14, Wrap=False)
unflatten_tree = UnflattenTree(Tree=replace_items, Guide=data_2)
unflatten_tree_2 = UnflattenTree(Tree=replace_items_2, Guide=data_2)
unflatten_tree_3 = UnflattenTree(Tree=replace_items_3, Guide=data_2)

number_slider_13 = Slider(2, range=0..10)
number_slider_14 = Slider(2.1, range=0..10)
number_slider_15 = Slider(0.2, range=0..1)
division_7 = Division(A=number_slider_14, B=Slider(2, range=0..10))
division_8 = Division(A=number_slider_15, B=Slider(2, range=0..10))
addition_9 = Addition(A=number_slider_13, B=Slider(0.2, range=0..1))
addition_10 = Addition(A=Slider(0, range=0..1), B=division_7, C=Slider(0.01, range=0..0.01))
addition_11 = Addition(A=addition_10, B=division_7, C=division_8)
unit_z_28 = UnitZ(Factor=addition_10)
unit_z_29 = UnitZ(Factor=addition_11)
construct_domain_6 = ConstructDomain(DomainStart=expr("-x/2", number_slider_13), DomainEnd=expr("x/2", number_slider_13))
construct_domain_7 = ConstructDomain(DomainStart=expr("-x/2", number_slider_14), DomainEnd=expr("x/2", number_slider_14))
construct_domain_8 = ConstructDomain(DomainStart=expr("-x/2", addition_9), DomainEnd=expr("x/2", addition_9))
construct_domain_9 = ConstructDomain(DomainStart=expr("-x/2", number_slider_15), DomainEnd=expr("x/2", number_slider_15))
move_14 = Move(Geometry=unflatten_tree_3, Motion=unit_z_28)  # -> Geometry, Transform
move_15 = Move(Geometry=unflatten_tree_3, Motion=unit_z_29)  # -> Geometry, Transform
rectangle_7 = Rectangle(Plane=move_15.Geometry, XSize=construct_domain_8, YSize=construct_domain_9, Radius=0)  # -> Rectangle, Length
rectangle_8 = Rectangle(Plane=move_14.Geometry, XSize=construct_domain_6, YSize=construct_domain_7, Radius=0)  # -> Rectangle, Length
merge_19 = Merge(Data1=rectangle_8.Rectangle, Data2=rectangle_7.Rectangle)
brep_join_2 = BrepJoin(Breps=merge_19)  # -> Breps, Closed
merge_faces_2 = MergeFaces(Brep=brep_join_2.Breps)  # -> Breps, Before, After
curve_21 = Curve(merge_faces_2.Breps)

number_slider_16 = Slider(1.4, range=0..10)
number_slider_17 = Slider(1.1, range=0..10)
number_slider_18 = Slider(0.2, range=0..1)
division_9 = Division(A=number_slider_17, B=Slider(2, range=0..10))
division_10 = Division(A=number_slider_18, B=Slider(2, range=0..10))
addition_12 = Addition(A=number_slider_16, B=Slider(0.2, range=0..1))
addition_13 = Addition(A=Slider(1, range=0..1), B=division_9)
addition_14 = Addition(A=addition_13, B=division_9, C=division_10)
unit_z_30 = UnitZ(Factor=addition_13)
unit_z_31 = UnitZ(Factor=addition_14)
construct_domain_10 = ConstructDomain(DomainStart=expr("-x/2", number_slider_16), DomainEnd=expr("x/2", number_slider_16))
construct_domain_11 = ConstructDomain(DomainStart=expr("-x/2", number_slider_17), DomainEnd=expr("x/2", number_slider_17))
construct_domain_12 = ConstructDomain(DomainStart=expr("-x/2", addition_12), DomainEnd=expr("x/2", addition_12))
construct_domain_13 = ConstructDomain(DomainStart=expr("-x/2", number_slider_18), DomainEnd=expr("x/2", number_slider_18))
move_16 = Move(Geometry=unflatten_tree, Motion=unit_z_31)  # -> Geometry, Transform
move_17 = Move(Geometry=unflatten_tree, Motion=unit_z_30)  # -> Geometry, Transform
rectangle_9 = Rectangle(Plane=move_16.Geometry, XSize=construct_domain_12, YSize=construct_domain_13, Radius=0)  # -> Rectangle, Length
rectangle_10 = Rectangle(Plane=move_17.Geometry, XSize=construct_domain_10, YSize=construct_domain_11, Radius=0)  # -> Rectangle, Length
merge_20 = Merge(Data1=rectangle_10.Rectangle, Data2=rectangle_9.Rectangle)
brep_join_3 = BrepJoin(Breps=merge_20)  # -> Breps, Closed
merge_faces_3 = MergeFaces(Brep=brep_join_3.Breps)  # -> Breps, Before, After
curve_22 = Curve(merge_faces_3.Breps)

number_slider_19 = Slider(1.5, range=0..10)
number_slider_20 = Slider(2.1, range=0..10)
number_slider_21 = Slider(0.2, range=0..1)
division_11 = Division(A=length_2, B=Slider(2, range=0..10))
division_12 = Division(A=number_slider_21, B=Slider(2, range=0..10))
addition_15 = Addition(A=length, B=Slider(0.2, range=0..1))
addition_16 = Addition(A=Slider(0, range=0..1), B=division_11, C=Slider(0.01, range=0..0.01))
addition_17 = Addition(A=addition_16, B=division_11, C=division_12)
unit_z_32 = UnitZ(Factor=addition_16)
unit_z_33 = UnitZ(Factor=addition_17)
construct_domain_14 = ConstructDomain(DomainStart=expr("-x/2", length), DomainEnd=expr("x/2", length))
construct_domain_15 = ConstructDomain(DomainStart=expr("-x/2", length_2), DomainEnd=expr("x/2", length_2))
construct_domain_16 = ConstructDomain(DomainStart=expr("-x/2", addition_15), DomainEnd=expr("x/2", addition_15))
construct_domain_17 = ConstructDomain(DomainStart=expr("-x/2", number_slider_21), DomainEnd=expr("x/2", number_slider_21))
move_18 = Move(Geometry=unflatten_tree_2, Motion=unit_z_32)  # -> Geometry, Transform
move_19 = Move(Geometry=unflatten_tree_2, Motion=unit_z_33)  # -> Geometry, Transform
rectangle_11 = Rectangle(Plane=move_19.Geometry, XSize=construct_domain_16, YSize=construct_domain_17, Radius=0)  # -> Rectangle, Length
rectangle_12 = Rectangle(Plane=move_18.Geometry, XSize=construct_domain_14, YSize=construct_domain_15, Radius=0)  # -> Rectangle, Length
merge_21 = Merge(Data1=rectangle_12.Rectangle, Data2=rectangle_11.Rectangle)
brep_join_4 = BrepJoin(Breps=merge_21)  # -> Breps, Closed
merge_faces_4 = MergeFaces(Brep=brep_join_4.Breps)  # -> Breps, Before, After
curve_23 = Curve(merge_faces_4.Breps)

merge_22 = Merge(Data1=rectangle_12.Rectangle)
merge_23 = Merge(Data1=move_18.Geometry)
orient = Orient(Geometry=list_item_2, Source=plane_origin, Target=merge_23)  # -> Geometry, Transform
grillage = ClusterOutput(orient.Geometry)
merge_24 = Merge(Data1=rectangle_8.Rectangle)
merge_25 = Merge(Data1=move_14.Geometry)
merge_26 = Merge(Data1=rectangle_10.Rectangle, Data2=rectangle_2.Rectangle)
merge_27 = Merge(Data1=move_17.Geometry, Data2=move_5.Geometry)
rectangle_door = ClusterOutput(merge_22)
plane_door = ClusterOutput(merge_23)
rectangle_garage = ClusterOutput(merge_24)
plane_garage = ClusterOutput(merge_25)
rectangle_window = ClusterOutput(merge_26)
plane_window = ClusterOutput(merge_27)

unit_z_34 = UnitZ(Factor=subtraction)

extrude_14 = Extrude(Base=curve_15, Direction=unit_z_34)

move_20 = Move(Geometry=extrude_14, Motion=unit_z_6)  # -> simplify(Geometry), Transform
curve_24 = Curve(simplify(graft(move_20.Geometry)))

merge_28 = Merge(Data1=curve_24, Data2=curve_16)  # -> flatten(Result)
boundary_surfaces_2 = BoundarySurfaces(Edges=merge_28)

curve_25 = Curve(curve_20)

extrude_15 = Extrude(Base=curve_25, Direction=unit_z_7)

curve_26 = Curve(simplify(graft(extrude_15)))

move_21 = Move(Geometry=line_pt, Motion=amplitude)  # -> Geometry, Transform
curve_27 = Curve(offset_curve_5)
explode_8 = Explode(Curve=curve_27, Recursive=True)  # -> Segments, Vertices
point_2 = Point(flatten(move_21.Geometry))
cull_duplicates_3 = CullDuplicates(Points=flatten([point_2, explode_8.Vertices]), Tolerance=0.1, CullMode=3)  # -> Points, Indices, Valence
curve_closest_point_5 = CurveClosestPoint(Point=cull_duplicates_3.Points, Curve=curve_27)  # -> Point, Parameter, Distance
evaluate_curve_6 = EvaluateCurve(Curve=simplify(graft(curve_27)), Parameter=curve_closest_point_5.Parameter)  # -> Point, Tangent, Angle
unit_z_35 = UnitZ(Factor=1)
rotate_4 = Rotate(Vector=evaluate_curve_6.Tangent, Axis=unit_z_35, Angle=degrees(-90))
amplitude_2 = Amplitude(Vector=rotate_4, Amplitude=maximum_4)
move_22 = Move(Geometry=evaluate_curve_6.Point, Motion=amplitude_2)  # -> Geometry, Transform
line_sdl_4 = LineSDL(Start=evaluate_curve_6.Point, Direction=evaluate_curve_6.Tangent, Length=1)
line_pt_4 = LinePt(Line=line_sdl_4, Point=move_22.Geometry)

# ---- group: cas de poteaux galerie
cull_pattern_5 = CullPattern(List=line_pt_4, CullPattern=larger_than_2.LargerThan)

# ----
rectangle_13 = Rectangle(Plane=cull_pattern_5, XSize=construct_domain_5, YSize=construct_domain_5, Radius=0)  # -> Rectangle, Length

surface_6 = Surface([rectangle_13.Rectangle, rectangle_3.Rectangle])
extrude_16 = Extrude(Base=surface_6, Direction=unit_z_4)

area_3 = Area(Geometry=surface_6)  # -> Area, Centroid
extrude_17 = Extrude(Base=surface_6, Direction=unit_z_10)
extrude_18 = Extrude(Base=surface_6, Direction=unit_z_11)
merge_29 = Merge(Data1=extrude_17, Data2=extrude_12)
merge_30 = Merge(Data1=extrude_18, Data2=extrude_13)  # -> flatten(Result)
move_23 = Move(Geometry=flatten(surface_6), Motion=unit_z_3)  # -> Geometry, Transform
move_24 = Move(Geometry=merge_30, Motion=unit_z_12)  # -> Geometry, Transform
move_25 = Move(Geometry=move_23.Geometry, Motion=unit_z_13)  # -> Geometry, Transform
move_26 = Move(Geometry=move_24.Geometry, Motion=unit_z_14)  # -> Geometry, Transform
extrude_19 = Extrude(Base=move_25.Geometry, Direction=unit_z_15)
merge_31 = Merge(Data1=extrude_19, Data2=move_26.Geometry, Data3=merge_29)
group_22 = Group(Objects=flatten(merge_31))
merge_32 = Merge(Data1=group_15, Data2=group_22, Data3=group_16, Data4=group_17)  # -> flatten(Result)
ungroup_4 = Ungroup(Group=merge_32)
structure = ClusterOutput(ungroup_4)
area_4 = Area(Geometry=merge_32)  # -> Area, Centroid; disabled
closest_points = ClosestPoints(Point=construct_point, Cloud=area_4.Centroid, Count=number_slider_5)  # -> ClosestPoint, CPIndex, Distance; disabled
list_item_15 = ListItem(List=merge_32, Index=closest_points.CPIndex, Wrap=True)  # disabled

merge_33 = Merge(Data1=simplify(curve_23), Data2=simplify(curve_21), Data3=simplify(curve_22), Data4=simplify(curve_26))  # -> flatten(Result)
boundary_surfaces_3 = BoundarySurfaces(Edges=merge_33)
merge_34 = Merge(
    Data1=simplify(rectangle_11.Rectangle),
    Data2=simplify(rectangle_7.Rectangle),
    Data3=simplify(rectangle_9.Rectangle),
    Data4=rectangle.Rectangle)
surface_7 = Surface(merge_34)
area_5 = Area(Geometry=surface_7)  # -> Area, Centroid
evaluate_surface = EvaluateSurface(Surface=surface_7, Point=area_5.Centroid)  # -> Point, Normal, UDirection, VDirection, Frame
amplitude_3 = Amplitude(Vector=evaluate_surface.Frame, Amplitude=expr("-x*2", maximum))
extrude_20 = Extrude(Base=surface_7, Direction=amplitude_3)

merge_35 = Merge(Data1=boundary_surfaces_3, Data2=boundary_surfaces_2)

area_6 = Area(Geometry=merge_35)  # -> Area, Centroid
evaluate_surface_2 = EvaluateSurface(Surface=merge_35, Point=area_6.Centroid)  # -> Point, Normal, UDirection, VDirection, Frame
amplitude_4 = Amplitude(Vector=evaluate_surface_2.Frame, Amplitude=expr("x*2", maximum))
extrude_21 = Extrude(Base=merge_35, Direction=amplitude_4)

group_23 = Group(Objects=flatten(extrude_20))
group_24 = Group(Objects=flatten(extrude_21))
merge_36 = Merge(
    Data1=flatten(extrude_7),
    Data2=flatten(move_11.Geometry),
    Data3=flatten(move_12.Geometry),
    Data4=flatten(merge_31),
    Data5=flatten(extrude_11),
    Data6=flatten(extrude_3),
    Data7=flatten(extrude_4),
    Data8=flatten(extrude_20))  # -> flatten(Result)
merge_37 = Merge(
    Data1=flatten(move_13.Geometry),
    Data2=flatten(extrude_10),
    Data3=flatten(extrude_2),
    Data4=flatten(extrude_5),
    Data5=flatten(extrude_21))  # -> reverse(Result)
merge_38 = Merge(Data1=group_18, Data2=group_19, Data3=group_20, Data4=group_24, Data5=group_21, Data6=group_23)
brep_concrete = ClusterOutput(merge_36)
brep_brick = ClusterOutput(merge_37)
ungroup_5 = Ungroup(Group=merge_38)
murs = ClusterOutput(ungroup_5)
