# Grasshopper definition clustered2.gh (Grasshopper 1.0.7)
# plug-ins: Pufferfish

radius = Slider(10, range=7..20)
count = Slider(7, range=7..20)
depth = GetNumber(count, AtLeast=1, AtMost=1, Maximum=1.797693135e+308, Minimum=-1.797693135e+308)
length = GetNumber(radius, AtLeast=1, AtMost=1, Maximum=1.797693135e+308, Minimum=-1.797693135e+308)

number_of_floors = Slider(2, range=1..4)
number_of_floors_2 = GetNumber(number_of_floors, AtLeast=1, AtMost=1, Maximum=1.797693135e+308, Minimum=-1.797693135e+308)

trame_de_sructure = Slider(3, range=2..6)
trame_de_sructure_2 = GetNumber(trame_de_sructure, AtLeast=1, AtMost=1, Maximum=1.797693135e+308, Minimum=-1.797693135e+308)

radius_2 = Slider(6, range=1..6)
number_of_façades = GetNumber(radius_2, AtLeast=1, AtMost=1, Maximum=1.797693135e+308, Minimum=-1.797693135e+308)

dom = ConstructDomain(DomainStart=expr("x/2", length), DomainEnd=expr("-x/2", length))
dom_2 = ConstructDomain(DomainStart=expr("x/2", depth), DomainEnd=expr("-x/2", depth))
rectangle = Rectangle(Plane=PlaneXY(0, 0, 0), XSize=dom, YSize=dom_2, Radius=0)  # -> Rectangle, Length
cluster = Cluster_2(
    input_curve=rectangle.Rectangle,
    number_floor=number_of_floors_2,
    number_facades=number_of_façades,
    hight_floor=Slider(3, range=0..10),
    hight_ground_floor=Slider(4, range=0..10),
    distance_corbelling=Slider(1.2, range=0..10),
    grid_structure=trame_de_sructure_2,
    hight_terrasse=Slider(1, range=0..10),
    number_doors=Slider(1, range=0..1),
    number_garages=Slider(2, range=0..10))  # -> srf_rdc, srf_etages, geo_concrete, geo_brick, area_brick, volume_concrete, fenetres, garages, portes
preview = CustomPreview(
    Geometry=[cluster.geo_brick, cluster.fenetres, cluster.garages, cluster.portes, cluster.geo_concrete],
    Material={diffuse=RGB(221, 160, 221), emission=RGB(66, 48, 66), shine=0.5, specular=RGB(255, 255, 255), transparency=0})
brep = Brep(cluster.fenetres)
brep_2 = Brep(cluster.portes)
brep_3 = Brep(cluster.garages)
divide = DivideDomain²(Domain=brep_2, UCount=Slider(7, range=0..100), VCount=Slider(1, range=0..10))
subsrf = Isotrim(Surface=graft(brep_2), Domain=divide)  # -> simplify(Surface)
divide_2 = DivideDomain²(Domain=brep_3, UCount=Slider(1, range=0..10), VCount=Slider(14, range=0..100))
divide_3 = DivideDomain²(Domain=brep, UCount=Slider(1, range=0..10), VCount=Slider(14, range=0..100))
crv = Curve(subsrf)
subsrf_2 = Isotrim(Surface=graft(brep_3), Domain=divide_2)  # -> simplify(Surface)
subsrf_3 = Isotrim(Surface=graft(brep), Domain=divide_3)  # -> simplify(Surface)
crv_2 = Curve(subsrf_2)
crv_3 = Curve(subsrf_3)

prix_de_ventre_m² = Slider(7000, range=1..99999)
selling_price_m² = GetNumber(prix_de_ventre_m², AtLeast=1, AtMost=1, Maximum=1.797693135e+308, Minimum=-1.797693135e+308)

prix_du_lot_m² = Slider(4000, range=1..99999)
land_price_m² = GetNumber(prix_du_lot_m², AtLeast=1, AtMost=1, Maximum=1.797693135e+308, Minimum=-1.797693135e+308)

prix_du_lot_m²_2 = Slider(1000, range=1..99999)
structure_shell_price_m² = GetNumber(prix_du_lot_m²_2, AtLeast=1, AtMost=1, Maximum=1.797693135e+308, Minimum=-1.797693135e+308)

division = Division(A=cluster.area_brick, B="0.25")

prix_du_lot_m²_3 = Slider(2000, range=1..99999)
interior_finishing_price_m² = GetNumber(prix_du_lot_m²_3, AtLeast=1, AtMost=1, Maximum=1.797693135e+308, Minimum=-1.797693135e+308)

int = Integer(division)

# ---- group: RH_OUT:brick
data = Data(int)

# ----
number_slider = Slider(1.06, range=0..10)
offset = OffsetCurve(Curve=cluster.srf_rdc, Distance=Slider(3, range=0..10), Corners=1)
tree_geometry = Mesh([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])
ext = ExtendCurve(Curve=offset, Type="0", Start=number_slider, End=number_slider)  # -> flatten(Curve)
group = Group(Objects=tree_geometry)
bbox = BoundingBox(Content=group, Plane=PlaneXY(0, 0, 0))  # -> Box, Box_2
debrep = DeconstructBrep(Brep=bbox.Box)  # -> Faces, Edges, Vertices
area = Area(Geometry=debrep.Faces)  # -> Area, Centroid
divdist = DivideDistance(Curve=ext, Distance=Slider(5, range=0..10))  # -> Points, Tangents, Parameters
lng = ListLength(List=divdist.Points)
pdecon = Deconstruct(Point=area.Centroid)  # -> XComponent, YComponent, ZComponent
cull_i = CullIndex(List=simplify(divdist.Points), Indices="0", Wrap=True)
sort = SortList(Keys=pdecon.ZComponent, ValuesA=debrep.Faces)  # -> Keys, ValuesA
item = ListItem(List=sort.ValuesA, Index=0, Wrap=True)
area_2 = Area(Geometry=item)  # -> Area, Centroid
move2pt = MoveToPoint(Geometry=group, PointA=area_2.Centroid, PointB=cull_i)  # -> Moved, Vector, Transform
ungroup = Ungroup(Group=move2pt.Moved)  # -> flatten(Objects)

number_slider_2 = Slider(1886, range=0..10000)

merge = Merge(Data1=crv_3, Data2=crv_2, Data3=crv)  # -> flatten(Result)
lng_2 = ListLength(List=flatten(merge))
repeat = RepeatData(Data=ColourSwatch(SwatchColor=RGB(255, 255, 255)), Length=lng_2)
c_script = CSharpScript(crv=merge, color=repeat)  # -> out, A; inputs crv: Curve, color: Color
# ---------- c_script: C# ----------
    var c = color.R + "," + color.G + "," + color.B;
    crv.SetUserString("color", c);
    A = crv;
# ---------- end c_script ----------

# ---- group: RH_OUT:edges
curve = Curve(flatten(c_script.A))

# ----
merge_2 = Merge(Data1=brep, Data2=brep_3, Data3=brep_2)

# ---- group: RH_OUT:mesh
mesh = Mesh(flatten([cluster.geo_concrete, cluster.geo_brick, ungroup, merge_2]))

# ----
cull_i_2 = CullIndex(List=cluster.srf_etages, Indices="0", Wrap=True)
crv_4 = Curve(cull_i_2)
area_3 = Area(Geometry=cluster.srf_rdc)  # -> Area, Centroid
multiplication = Multiplication(A=area_3.Area, B=land_price_m²)
addition = Addition(A=structure_shell_price_m², B=interior_finishing_price_m²)

area_4 = Area(Geometry=crv_4)  # -> Area, Centroid
ma = MassAddition(Input=area_4.Area)  # -> Result, PartialResults

# ---- group: RH_OUT:area
data_2 = Data(ma.Result)

# ----
multiplication_2 = Multiplication(A=ma.Result, B=addition)
addition_2 = Addition(A=multiplication, B=multiplication_2)
multiplication_3 = Multiplication(A=selling_price_m², B=ma.Result)
division_2 = Division(A=addition_2, B=multiplication_3)
multiplication_4 = Multiplication(A=division_2, B=Slider(100, range=0..100))
expression = Expression(x=multiplication_4, Expression="if(x>100,-x,x)")
round = Round(Number=expression)  # -> Nearest, Floor, Ceiling
panel = Panel(round.Nearest)

# ---- group: RH_OUT:price1
data_3 = Data(multiplication_3)

# ---- group: RH_OUT:price
data_4 = Data(addition_2)

# ----
subtraction = Subtraction(A=data_3, B=data_4)

# ---- group: RH_OUT:price2
data_5 = Data(subtraction)

# ---- group: RH_OUT:price3
data_6 = Data(round.Nearest)

# ==== cluster Cluster_2
hight_ground_floor = ClusterInput()
distance_corbelling = ClusterInput()
grid_structure = ClusterInput()
number_doors = ClusterInput()
number_garages = ClusterInput()
hight_terrasse = ClusterInput()
number_facades = ClusterInput()
hight_floor = ClusterInput()
input_curve = ClusterInput()
number_floor = ClusterInput()
number_slider = Slider(1.2, range=0..10)
number_slider_2 = Slider(2, range=0..10)
number_slider_3 = Slider(6, range=0..10)
number_slider_4 = Slider(1.2, range=0..10)
number_slider_5 = Slider(1, range=0..10)
number_slider_6 = Slider(0, range=0..10)
number_slider_7 = Slider(6, range=0..10)
number_slider_8 = Slider(3, range=0..10)
curve = Curve(input_curve)
project = Project(Geometry=curve, Plane=PlaneXY(0, 0, 0))  # -> Geometry, Transform
explode = Explode(Curve=project.Geometry, Recursive=True)  # -> Segments, Vertices
number_slider_9 = Slider(1, range=0..1)
list_item = ListItem(List=explode.Segments, Index=0, Wrap=True)
negative = Negative(Value=number_slider_9)
offset_curve = OffsetCurve(Curve=list_item, Distance=negative, Corners=1)
offset_curve_2 = OffsetCurve(Curve=list_item, Distance=number_slider_9, Corners=1)
point_on_curve = PointOnCurve(offset_curve_2, parameter=0.5)
point_on_curve_2 = PointOnCurve(offset_curve, parameter=0.5)
point_in_curve = PointInCurve(Point=point_on_curve_2, Curve=project.Geometry)  # -> Relationship, Point
point_in_curve_2 = PointInCurve(Point=point_on_curve, Curve=project.Geometry)  # -> Relationship, Point
flip_curve = FlipCurve(Curve=project.Geometry)  # -> Curve, Flag
merge = Merge(Data1=project.Geometry, Data2=flip_curve.Curve)  # -> flatten(Result)
merge_2 = Merge(Data1=point_in_curve_2.Relationship, Data2=point_in_curve.Relationship)
cull_pattern = CullPattern(List=merge, CullPattern=merge_2)
grid_structure_2 = Slider(2.8, range=2.8..6)
h_terrasse = Slider(0.4, range=0.4..1.5)
encorbellement = Slider(0.3, range=0.3..4)
n_stories = Slider(1, range=0..7)
h_etage = Slider(3, range=3..4)
h_rdc = Slider(3.2, range=3.2..5)
number_slider_10 = Slider(0.24, range=0..1)
maximum = Maximum(A=n_stories, B=number_floor)
maximum_2 = Maximum(A=h_terrasse, B=hight_terrasse)
explode_2 = Explode(Curve=cull_pattern, Recursive=True)  # -> Segments, Vertices
maximum_3 = Maximum(A=grid_structure_2, B=grid_structure)
maximum_4 = Maximum(A=encorbellement, B=distance_corbelling)
maximum_5 = Maximum(A=h_rdc, B=hight_ground_floor)
maximum_6 = Maximum(A=h_etage, B=hight_floor)
number_slider_11 = Slider(3, range=0..10)
minimum = Minimum(A=maximum_4, B=Slider(4, range=0..10))
minimum_2 = Minimum(A=maximum_2, B=Slider(1.5, range=0..10))
list_length = ListLength(List=explode_2.Segments)
minimum_3 = Minimum(A=maximum_3, B=Slider(8, range=0..10))
minimum_4 = Minimum(A=number_facades, B=list_length)
subtraction = Subtraction(A=list_length, B=minimum_4)
merge_3 = Merge(Data1=Toggle(False), Data2=Toggle(False), Data3=Toggle(True), Data4=Toggle(True))
negative_2 = Negative(Value=minimum)
repeat_data = RepeatData(Data=Slider(1, range=0..1), Length=minimum_4)
repeat_data_2 = RepeatData(Data=Slider(0, range=0..100), Length=subtraction)
number = Number(negative_2)
series = Series(Start=maximum_5, Step=maximum_6, Count=expr("x+1", maximum))
multiplication = Multiplication(A=maximum_6, B=maximum)
series_2 = Series(Start=maximum_5, Step=maximum_6, Count=maximum)
multiplication_2 = Multiplication(A=number_slider_10, B=Slider(2, range=0..10))
merge_4 = Merge(Data1=repeat_data, Data2=repeat_data_2)
dispatch = Dispatch(List=explode_2.Segments, DispatchPattern=merge_4)  # -> ListA, ListB
unit_z = UnitZ(Factor=series_2)
subtraction_2 = Subtraction(A=minimum_2, B=number_slider_10)
addition = Addition(A=multiplication, B=maximum_5, C=minimum_2)
addition_2 = Addition(A=multiplication, B=maximum_5, C=number_slider_10)
subtraction_3 = Subtraction(A=maximum_5, B=multiplication_2)
subtraction_4 = Subtraction(A=maximum_6, B=multiplication_2)
subtraction_5 = Subtraction(A=maximum_5, B=multiplication_2)
addition_3 = Addition(A=multiplication, B=maximum_5)
srf_rdc = ClusterOutput(cull_pattern)  # SRF RDC
curve_2 = Curve(cull_pattern)
unit_z_2 = UnitZ(Factor=series)
unit_z_3 = UnitZ(Factor=subtraction_2)
unit_z_4 = UnitZ(Factor=addition)
unit_z_5 = UnitZ(Factor=addition_3)
unit_z_6 = UnitZ(Factor=number_slider_10)
unit_z_7 = UnitZ(Factor=addition_2)
offset_curve_3 = OffsetCurve(Curve=curve_2, Distance=expr("X/2", number_slider_10), Plane=PlaneXY(0, 0, 0), Corners=1)
negative_3 = Negative(Value=unit_z_6)
explode_3 = Explode(Curve=offset_curve_3, Recursive=True)  # -> Segments, Vertices
curve_3 = Curve(simplify(graft(explode_3.Segments)))
length = Length(Curve=curve_3)
division = Division(A=length, B=minimum_3)
divide_curve = DivideCurve(Curve=curve_3, Count=division, Kinks=False)  # -> Points, Tangents, Parameters
division_2 = Division(A=number_slider_10, B=Slider(2, range=0..10))
negative_4 = Negative(Value=division_2)
plane_origin = PlaneOrigin(Base=divide_curve.Points, Origin=divide_curve.Points)
area = Area(Geometry=cull_pattern)  # -> Area, Centroid
unit_x = UnitX(Factor=divide_curve.Points)
shatter = Shatter(Curve=curve_3, Parameters=divide_curve.Parameters)
angle = Angle(VectorA=unit_x, VectorB=divide_curve.Tangents)  # -> Angle, Reflex
plane_origin_2 = PlaneOrigin(Base=area.Centroid, Origin=area.Centroid)
extend_curve = ExtendCurve(Curve=shatter, Type=0, Start=negative_4, End=negative_4)
rotate_plane = RotatePlane(Plane=plane_origin, Angle=angle.Angle)
offset_curve_4 = OffsetCurve(Curve=extend_curve, Distance=negative_4, Plane=PlaneXY(0, 0, 0), Corners=1)
offset_curve_5 = OffsetCurve(Curve=extend_curve, Distance=division_2, Plane=PlaneXY(0, 0, 0), Corners=1)
unflatten_tree = UnflattenTree(Tree=offset_curve_4, Guide=extend_curve)
group = Group(Objects=unflatten_tree)  # -> flatten(Group)
dispatch_2 = Dispatch(List=group, DispatchPattern=merge_4)  # -> ListA, ListB
ungroup = Ungroup(Group=dispatch_2.ListA)
number_slider_12 = Slider(1, range=0..1)
curve_4 = Curve(ungroup)
maximum_7 = Maximum(A=number_doors, B=Slider(1, range=0..1))
move = Move(Geometry=curve_4, Motion=unit_z_6)  # -> Geometry, Transform
evaluate_curve = EvaluateCurve(Curve=reparameterize(move.Geometry), Parameter=Slider(0.5, range=0..1))  # -> Point, Tangent, Angle
line_sdl = LineSDL(Start=evaluate_curve.Point, Direction=evaluate_curve.Tangent, Length=1)
move_2 = Move(Geometry=evaluate_curve.Point, Motion=Vector(0, 0, 10))  # -> Geometry, Transform
line_pt = LinePt(Line=line_sdl, Point=move_2.Geometry)
list_length_2 = ListLength(List=flatten(line_pt))
series_3 = Series(Start=0, Step=1, Count=list_length_2)
random_reduce = RandomReduce(List=series_3, Reduction=maximum_7, Seed=1)
list_item_2 = ListItem(List=series_3, Index=random_reduce, Wrap=True)
offset_curve_6 = OffsetCurve(Curve=move.Geometry, Distance=number, Plane=PlaneXY(0, 0, 0), Corners=1)  # -> simplify(Curve)
number_slider_13 = Slider(2, range=0..10)
maximum_8 = Maximum(A=number_garages, B=Slider(0, range=0..1))
data = Data(line_pt)
random_reduce_2 = RandomReduce(List=list_item_2, Reduction=maximum_8, Seed=1)
unflatten_tree_2 = UnflattenTree(Tree=offset_curve_6, Guide=move.Geometry)
cull_index = CullIndex(List=series_3, Indices=random_reduce, Wrap=True)
data_2 = Data(flatten(data))
list_item_3 = ListItem(List=series_3, Index=[random_reduce_2, cull_index], Wrap=True)
cull_index_2 = CullIndex(List=series_3, Indices=[random_reduce_2, cull_index], Wrap=True)
evaluate_curve_2 = EvaluateCurve(Curve=reparameterize(unflatten_tree_2), Parameter=Slider(0.5, range=0..1))  # -> Point, Tangent, Angle
curve_5 = Curve(dispatch.ListA)
join_curves = JoinCurves(Curves=curve_5, Preserve=False)
replace_items = ReplaceItems(List=data_2, Indices=flatten([cull_index_2, cull_index]), Wrap=False)
replace_items_2 = ReplaceItems(List=data_2, Indices=list_item_2, Wrap=False)
replace_items_3 = ReplaceItems(List=data_2, Indices=list_item_3, Wrap=False)
line_sdl_2 = LineSDL(Start=evaluate_curve_2.Point, Direction=evaluate_curve_2.Tangent, Length=1)
move_3 = Move(Geometry=evaluate_curve_2.Point, Motion=Vector(0, 0, 10))  # -> Geometry, Transform
unflatten_tree_3 = UnflattenTree(Tree=replace_items_2, Guide=data)
unflatten_tree_4 = UnflattenTree(Tree=replace_items, Guide=data)
unflatten_tree_5 = UnflattenTree(Tree=replace_items_3, Guide=data)
offset_curve_7 = OffsetCurve(Curve=join_curves, Distance=number, Plane=PlaneXY(0, 0, 0), Corners=1)
cull_pattern_2 = CullPattern(List=explode_3.Segments, CullPattern=merge_4)  # -> graft(List)
ungroup_2 = Ungroup(Group=dispatch_2.ListB)
line_pt_2 = LinePt(Line=line_sdl_2, Point=move_3.Geometry)
end_points = EndPoints(Curve=simplify(graft(join_curves)))  # -> Start, End
end_points_2 = EndPoints(Curve=simplify(offset_curve_7))  # -> Start, End
data_3 = Data(ungroup_2)
length_2 = Length(Curve=cull_pattern_2)
curve_6 = Curve(ungroup_2)
construct_domain = ConstructDomain(DomainStart=expr("-x/2", number_slider_10), DomainEnd=expr("x/2", number_slider_10))
line = Line(StartPoint=end_points_2.Start, EndPoint=end_points.Start)
line_2 = Line(StartPoint=end_points_2.End, EndPoint=end_points.End)
division_3 = Division(A=length_2, B=minimum_3)
number_slider_14 = Slider(1.4, range=1..2)
number_slider_15 = Slider(1.4, range=1..2)
number_slider_16 = Slider(2, range=0..5)
number_slider_17 = Slider(1.3, range=1.2..1.5)
cull_index_3 = CullIndex(List=rotate_plane, Indices=Slider(0, range=0..100), Wrap=True)
number_slider_18 = Slider(1.25, range=1.2..1.5)
number_slider_19 = Slider(2.5, range=0..4)
number_slider_20 = Slider(1.2, range=0..5)
number_slider_21 = Slider(2.4, range=0..4)
move_4 = Move(Geometry=curve_6, Motion=unit_z_6)  # -> graft(Geometry), Transform
divide_curve_2 = DivideCurve(Curve=cull_pattern_2, Count=division_3, Kinks=False)  # -> Points, Tangents, Parameters
join_curves_2 = JoinCurves(Curves=[line, line_2], Preserve=False)  # -> graft(Curves)
addition_4 = Addition(A=number_slider_20, B=Slider(0.2, range=0..1))
null_item = NullItem(Item=join_curves_2)  # -> NullFlags, InvalidFlags, Description
addition_5 = Addition(A=number_slider_14, B=Slider(0.2, range=0..1))
addition_6 = Addition(A=number_slider_16, B=Slider(0.2, range=0..1))
addition_7 = Addition(A=number_slider_15, B=Slider(0.2, range=0..1))
rectangle = Rectangle(Plane=cull_index_3, XSize=construct_domain, YSize=construct_domain, Radius=0)  # -> Rectangle, Length
merge_5 = Merge(Data1=explode_2.Segments, Data2=join_curves_2)  # -> graft(Result)
move_5 = Move(Geometry=move_4.Geometry, Motion=unit_z)  # -> Geometry, Transform
construct_domain_2 = ConstructDomain(DomainStart=expr("-x/2", number_slider_14), DomainEnd=expr("x/2", number_slider_14))
construct_domain_3 = ConstructDomain(DomainStart=expr("-x/2", number_slider_17), DomainEnd=expr("x/2", number_slider_17))
construct_domain_4 = ConstructDomain(DomainStart=expr("-x/2", number_slider_16), DomainEnd=expr("x/2", number_slider_16))
construct_domain_5 = ConstructDomain(DomainStart=expr("-x/2", number_slider_19), DomainEnd=expr("x/2", number_slider_19))
construct_domain_6 = ConstructDomain(DomainStart=expr("-x/2", number_slider_15), DomainEnd=expr("x/2", number_slider_15))
construct_domain_7 = ConstructDomain(DomainStart=expr("-x/2", number_slider_18), DomainEnd=expr("x/2", number_slider_18))
construct_domain_8 = ConstructDomain(DomainStart=expr("-x/2", addition_5), DomainEnd=expr("x/2", addition_5))
construct_domain_9 = ConstructDomain(DomainStart=expr("-x/2", addition_6), DomainEnd=expr("x/2", addition_6))
construct_domain_10 = ConstructDomain(DomainStart=expr("-x/2", addition_7), DomainEnd=expr("x/2", addition_7))
division_4 = Division(A=number_slider_17, B=Slider(2, range=0..10))
construct_domain_11 = ConstructDomain(DomainStart=expr("-x/2", number_slider_20), DomainEnd=expr("x/2", number_slider_20))
division_5 = Division(A=number_slider_19, B=Slider(2, range=0..10))
construct_domain_12 = ConstructDomain(DomainStart=expr("-x/2", number_slider_21), DomainEnd=expr("x/2", number_slider_21))
division_6 = Division(A=number_slider_18, B=Slider(2, range=0..10))
dispatch_3 = Dispatch(List=join_curves_2, DispatchPattern=null_item.InvalidFlags)  # -> ListA, ListB
curve_7 = Curve(flatten([dispatch_3.ListB, offset_curve_7]))
join_curves_3 = JoinCurves(Curves=curve_7, Preserve=False)
curve_8 = Curve(simplify(graft([curve_6, join_curves_3])))
explode_4 = Explode(Curve=curve_8, Recursive=True)  # -> simplify(Segments), Vertices
line_sdl_3 = LineSDL(Start=divide_curve_2.Points, Direction=divide_curve_2.Tangents, Length=1)
construct_domain_13 = ConstructDomain(DomainStart=expr("-x/2", addition_4), DomainEnd=expr("x/2", addition_4))
division_7 = Division(A=number_slider_21, B=Slider(2, range=0..10))
unit_z_8 = UnitZ(Factor=number_slider_10)
move_6 = Move(Geometry=divide_curve_2.Points, Motion=Vector(0, 0, 10))  # -> Geometry, Transform
group_2 = Group(Objects=rectangle.Rectangle)  # -> flatten(Group)
join_curves_4 = JoinCurves(Curves=flatten([join_curves_2, offset_curve_7, dispatch.ListB]), Preserve=False)
addition_8 = Addition(A=division_5, B=Slider(0.01, range=0..1))
addition_9 = Addition(A=division_7, B=Slider(0.03, range=0..1))
cluster = Cluster(distance=subtraction_5, curve=graft(move_4.Geometry))  # -> simplify(curves)
cluster_2 = Cluster(distance=subtraction_4, curve=graft(move_5.Geometry))  # -> simplify(curves)
addition_10 = Addition(A=division_4, B=Slider(1, range=0..1))
addition_11 = Addition(A=division_6, B=Slider(1, range=0..1))
move_7 = Move(Geometry=join_curves_2, Motion=unit_z_8)  # -> Geometry, Transform
addition_12 = Addition(A=addition_8, B=division_5)
rectangle_2 = Rectangle(Plane=line_pt_2, XSize=construct_domain_2, YSize=construct_domain_3, Radius=0)  # -> Rectangle, Length
rectangle_3 = Rectangle(Plane=unflatten_tree_5, XSize=construct_domain_4, YSize=construct_domain_5, Radius=0)  # -> Rectangle, Length
rectangle_4 = Rectangle(Plane=unflatten_tree_5, XSize=construct_domain_9, YSize=Slider(0.2, range=0..1), Radius=0)  # -> Rectangle, Length
rectangle_5 = Rectangle(Plane=unflatten_tree_4, XSize=construct_domain_6, YSize=construct_domain_7, Radius=0)  # -> Rectangle, Length
rectangle_6 = Rectangle(Plane=line_pt_2, XSize=construct_domain_8, YSize=Slider(0.2, range=0..1), Radius=0)  # -> Rectangle, Length
rectangle_7 = Rectangle(Plane=unflatten_tree_4, XSize=construct_domain_10, YSize=Slider(0.2, range=0..1), Radius=0)  # -> Rectangle, Length
line_pt_3 = LinePt(Line=line_sdl_3, Point=move_6.Geometry)
rectangle_8 = Rectangle(Plane=unflatten_tree_3, XSize=construct_domain_11, YSize=construct_domain_12, Radius=0)  # -> Rectangle, Length
rectangle_9 = Rectangle(Plane=unflatten_tree_3, XSize=construct_domain_13, YSize=Slider(0.2, range=0..1), Radius=0)  # -> Rectangle, Length
dispatch_4 = Dispatch(List=group_2, DispatchPattern=merge_4)  # -> ListA, ListB
addition_13 = Addition(A=division_7, B=addition_9)
addition_14 = Addition(A=division_4, B=addition_10)
addition_15 = Addition(A=division_6, B=addition_11)
move_8 = Move(Geometry=explode_4.Segments, Motion=unit_z_7)  # -> Geometry, Transform
move_9 = Move(Geometry=join_curves_4, Motion=unit_z_6)  # -> Geometry, Transform
unit_z_9 = UnitZ(Factor=series_2)
unit_z_10 = UnitZ(Factor=addition_14)
surface = Surface([cluster_2, cluster])
unit_z_11 = UnitZ(Factor=addition_10)
move_10 = Move(Geometry=rectangle_2.Rectangle, Motion=unit_z_11)  # -> simplify(Geometry), Transform
ungroup_3 = Ungroup(Group=dispatch_4.ListB)
ungroup_4 = Ungroup(Group=dispatch_4.ListA)
cluster_3 = Cluster(distance=subtraction_2, curve=graft(move_8.Geometry))  # -> simplify(curves)
boundary_surfaces = BoundarySurfaces(Edges=move_9.Geometry)
construct_domain_14 = ConstructDomain(DomainStart=expr("-x/2", number_slider_10), DomainEnd=expr("x/2", number_slider_10))
move_11 = Move(Geometry=rectangle_6.Rectangle, Motion=unit_z_10)  # -> simplify(Geometry), Transform
move_12 = Move(Geometry=move_7.Geometry, Motion=unit_z_9)  # -> Geometry, Transform
unit_z_12 = UnitZ(Factor=number_slider_10)
negative_5 = Negative(Value=number_slider_10)
brep = Brep(move_10.Geometry)
brep_join = BrepJoin(Breps=[move_10.Geometry, move_11.Geometry])  # -> Breps, Closed
unit_z_13 = UnitZ(Factor=addition_9)
unit_z_14 = UnitZ(Factor=addition_8)
unit_z_15 = UnitZ(Factor=addition_13)
unit_z_16 = UnitZ(Factor=addition_12)
unit_z_17 = UnitZ(Factor=addition_15)
move_13 = Move(Geometry=boundary_surfaces, Motion=unit_z_2)  # -> Geometry, Transform
unit_z_18 = UnitZ(Factor=addition_11)
cluster_4 = Cluster(distance=subtraction_3, curve=move.Geometry)  # -> simplify(curves)
extrude = Extrude(Base=merge_5, Direction=negative_3)
surface_2 = Surface(ungroup_3)
surface_3 = Surface(ungroup_4)
mesh = Mesh(brep_join.Breps)
move_14 = Move(Geometry=offset_curve_7, Motion=unit_z_12)  # -> Geometry, Transform
move_15 = Move(Geometry=rectangle_3.Rectangle, Motion=unit_z_14)  # -> simplify(graft(Geometry)), Transform
move_16 = Move(Geometry=rectangle_8.Rectangle, Motion=unit_z_13)  # -> simplify(graft(Geometry)), Transform
move_17 = Move(Geometry=rectangle_9.Rectangle, Motion=unit_z_15)  # -> simplify(graft(Geometry)), Transform
cluster_5 = Cluster(distance=subtraction_4, curve=graft(move_12.Geometry))  # -> simplify(curves)
move_18 = Move(Geometry=rectangle_4.Rectangle, Motion=unit_z_16)  # -> simplify(graft(Geometry)), Transform
rectangle_10 = Rectangle(Plane=line_pt_3, XSize=construct_domain_14, YSize=negative_5, Radius=0)  # -> Rectangle, Length
extrude_2 = Extrude(Base=surface_3, Direction=unit_z_5)
extrude_3 = Extrude(Base=surface_2, Direction=unit_z_4)
srf_etages = ClusterOutput(move_13.Geometry)  # SRF ETAGES
move_19 = Move(Geometry=rectangle_5.Rectangle, Motion=unit_z_18)  # -> simplify(graft(Geometry)), Transform
move_20 = Move(Geometry=rectangle_7.Rectangle, Motion=unit_z_17)  # -> simplify(graft(Geometry)), Transform
unit_z_19 = UnitZ(Factor=maximum_5)
weaverbird_s_naked_boundary = WeaverbirdsNakedBoundary(MeshClosedPolylines=mesh)
move_21 = Move(Geometry=extrude, Motion=unit_z_2)  # -> Geometry, Transform
extrude_4 = Extrude(Base=[boundary_surfaces, move_13.Geometry], Direction=negative_3)
group_3 = Group(Objects=move_11.Geometry)
explode_5 = Explode(Curve=move_14.Geometry, Recursive=True)  # -> simplify(graft(Segments)), Vertices
brep_2 = Brep(move_15.Geometry)
unit_z_20 = UnitZ(Factor=series_2)
brep_3 = Brep(move_16.Geometry)
group_4 = Group(Objects=weaverbird_s_naked_boundary)
surface_4 = Surface(cluster_5)
move_22 = Move(Geometry=graft(brep), Motion=unit_z)  # -> simplify(Geometry), Transform
brep_join_2 = BrepJoin(Breps=[move_16.Geometry, move_17.Geometry])  # -> Breps, Closed
brep_join_3 = BrepJoin(Breps=[move_20.Geometry, move_19.Geometry])  # -> Breps, Closed
move_23 = Move(Geometry=rectangle_10.Rectangle, Motion=unit_z_19)  # -> Geometry, Transform
brep_join_4 = BrepJoin(Breps=[move_15.Geometry, move_18.Geometry])  # -> Breps, Closed
planar = IsPlanar(Surface=brep_3, Interior=True)  # -> Planar, Plane
surface_5 = Surface(flatten(cluster_3))
move_24 = Move(Geometry=graft(group_3), Motion=unit_z)  # -> simplify(Geometry), Transform
move_25 = Move(Geometry=graft(group_4), Motion=unit_z)  # -> simplify(Geometry), Transform
planar_2 = IsPlanar(Surface=brep_2, Interior=True)  # -> Planar, Plane
move_26 = Move(Geometry=explode_5.Segments, Motion=unit_z_20)  # -> simplify(Geometry), Transform
mesh_2 = Mesh(brep_join_2.Breps)
mesh_3 = Mesh(brep_join_3.Breps)
mesh_4 = Mesh(brep_join_4.Breps)
subtraction_6 = Subtraction(A=maximum_6, B=number_slider_10)
merge_6 = Merge(Data1=move_22.Geometry, Data2=move_19.Geometry)
weaverbird_s_naked_boundary_2 = WeaverbirdsNakedBoundary(MeshClosedPolylines=mesh_3)
weaverbird_s_naked_boundary_3 = WeaverbirdsNakedBoundary(MeshClosedPolylines=mesh_4)
weaverbird_s_naked_boundary_4 = WeaverbirdsNakedBoundary(MeshClosedPolylines=mesh_2)
area_2 = Area(Geometry=surface_5)  # -> Area, Centroid
ungroup_5 = Ungroup(Group=move_24.Geometry)  # -> simplify(Objects)
planar_3 = IsPlanar(Surface=merge_6, Interior=True)  # -> Planar, Plane
ungroup_6 = Ungroup(Group=move_25.Geometry)  # -> simplify(Objects)
cluster_6 = Cluster(distance=subtraction_6, curve=graft(move_26.Geometry))  # -> simplify(curves)
surface_6 = Surface(flatten(move_23.Geometry))
area_3 = Area(Geometry=surface_6)  # -> Area, Centroid
merge_7 = Merge(Data1=move_20.Geometry, Data2=move_18.Geometry, Data3=move_17.Geometry, Data4=ungroup_5)  # -> flatten(Result)
evaluate_surface = EvaluateSurface(Surface=surface_5, Point=area_2.Centroid)  # -> Point, Normal, UDirection, VDirection, Frame
boundary_surfaces_2 = BoundarySurfaces(Edges=flatten([cluster_6, ungroup_6]))
merge_8 = Merge(Data1=weaverbird_s_naked_boundary_2, Data2=weaverbird_s_naked_boundary_3, Data3=weaverbird_s_naked_boundary_4)
area_4 = Area(Geometry=surface_6)  # -> Area, Centroid
surface_7 = Surface(merge_7)
null_item_2 = NullItem(Item=merge_7)  # -> NullFlags, InvalidFlags, Description
cull_pattern_3 = CullPattern(List=merge_7, CullPattern=null_item_2.InvalidFlags)
number_slider_22 = Slider(0.2, range=0..1)
amp = Amplitude(Vector=planar.Plane, Amplitude=number_slider_22)
move_27 = Move(Geometry=brep_3, Motion=amp)  # -> Geometry, Transform
amp_2 = Amplitude(Vector=planar_2.Plane, Amplitude=number_slider_22)
move_28 = Move(Geometry=brep_2, Motion=amp_2)  # -> Geometry, Transform
portes = ClusterOutput(move_27.Geometry)  # PORTES
amp_3 = Amplitude(Vector=planar_3.Plane, Amplitude=number_slider_22)
garages = ClusterOutput(move_28.Geometry)  # GARAGES
move_29 = Move(Geometry=merge_6, Motion=amp_3)  # -> Geometry, Transform
srf = Surface(move_29.Geometry)
fenetres = ClusterOutput(srf)  # FENETRES
evaluate_surface_2 = EvaluateSurface(Surface=surface_6, Point=area_4.Centroid)  # -> Point, Normal, UDirection, VDirection, Frame
dispatch_5 = Dispatch(List=merge_7, DispatchPattern=null_item_2.InvalidFlags)  # -> ListA, ListB
boundary_surfaces_3 = BoundarySurfaces(Edges=[cluster_4, merge_8])
amplitude = Amplitude(Vector=evaluate_surface.Frame, Amplitude=number_slider_22)
extrude_5 = Extrude(Base=surface_5, Direction=amplitude)
surface_8 = Surface(flatten(dispatch_5.ListB))
amplitude_2 = Amplitude(Vector=evaluate_surface_2.Frame, Amplitude=minimum)
area_5 = Area(Geometry=surface_8)  # -> Area, Centroid
surface_9 = Surface([boundary_surfaces_2, boundary_surfaces_3])
negative_6 = Negative(Value=amplitude_2)
area_6 = Area(Geometry=surface_9)  # -> Area, Centroid
area_7 = Area(Geometry=surface_8)  # -> Area, Centroid
extrude_6 = Extrude(Base=surface_6, Direction=negative_6)
area_8 = Area(Geometry=surface_9)  # -> Area, Centroid
evaluate_surface_3 = EvaluateSurface(Surface=surface_8, Point=area_7.Centroid)  # -> Point, Normal, UDirection, VDirection, Frame
evaluate_surface_4 = EvaluateSurface(Surface=surface_9, Point=area_8.Centroid)  # -> Point, Normal, UDirection, VDirection, Frame
amplitude_3 = Amplitude(Vector=evaluate_surface_3.Frame, Amplitude=Slider(0.2, range=0..1))
amplitude_4 = Amplitude(Vector=evaluate_surface_4.Frame, Amplitude=Slider(0.2, range=0..1))
extrude_7 = Extrude(Base=surface_8, Direction=amplitude_3)
merge_9 = Merge(
    Data1=flatten(move_21.Geometry),
    Data2=flatten(extrude_4),
    Data3=flatten(extrude_3),
    Data4=flatten(extrude_2),
    Data5=flatten(extrude_7),
    Data6=flatten(extrude_6))  # -> flatten(Result)
merge_10 = Merge(Data1=boundary_surfaces_3, Data2=boundary_surfaces_2, Data3=surface_4, Data5=cluster_3, Data6=cluster_3, Data7=surface)  # -> flatten(Result)
merge_11 = Merge(Data1=extrude_2, Data2=extrude_3, Data3=extrude_4, Data4=extrude_7, Data5=extrude_6)  # -> flatten(Result)
extrude_8 = Extrude(Base=surface_9, Direction=amplitude_4)
merge_12 = Merge(Data1=surface_4, Data2=extrude_5, Data3=extrude_8, Data4=surface)
geo_concrete = ClusterOutput(merge_9)
geo_brick = ClusterOutput(merge_12)
number_slider_23 = Slider(3.8, range=0..10)
area_9 = Area(Geometry=merge_10)  # -> Area, Centroid
volume = Volume(Geometry=merge_11)  # -> Volume, Centroid
mass_addition = MassAddition(Input=area_9.Area)  # -> Result, PartialResults
rectangle_11 = Rectangle(Plane=PlaneXY(0, 0, 0), XSize=number_slider_23, YSize=number_slider_23, Radius=0)  # -> Rectangle, Length
mass_addition_2 = MassAddition(Input=volume.Volume)  # -> Result, PartialResults
area_brick = ClusterOutput(mass_addition.Result)
box_rectangle = BoxRectangle(Rectangle=rectangle_11.Rectangle, Height=number_slider_23)
volume_concrete = ClusterOutput(mass_addition_2.Result)
boxmapping = BoxMapping(Mesh=merge_12, Box=box_rectangle)
file_path = FilePath("C:\Users\hp\Desktop\brick_texture___6_by_agf81_d37gm2w-fullview.jpg")
file_path_2 = FilePath("C:\Users\hp\Desktop\d041f106526966d79ded13252ecc4639.jpg")
custom_preview_materials = CustomPreviewMaterials(Geometry=merge_9, DiffuseColor=RGB(255, 255, 255), DiffuseBitmap=file_path_2)
custom_preview_materials_2 = CustomPreviewMaterials(Geometry=boxmapping, DiffuseColor=RGB(255, 255, 255), DiffuseBitmap=file_path)
panel = Panel("""Start 
for alteration""")
galapagos = Galapagos()

# ==== cluster Cluster
curve = ClusterInput()
curve_2 = Curve(reparameterize(curve))
explode = Explode(Curve=curve_2, Recursive=True)  # -> graft(Segments), Vertices
curve_3 = Curve(reparameterize(simplify(explode.Segments)))
perp_frame = PerpFrame(Curve=curve_3, Parameter=Slider(0.5, range=0..1))
xy_plane = XYPlane(Origin=Point(0, 0, 0))
plane_origin = PlaneOrigin(Base=xy_plane, Origin=perp_frame)
rotate = Rotate(Geometry=perp_frame, Angle=degrees(Slider(90, range=0..100)), Plane=plane_origin)  # -> Geometry, Transform
distance = ClusterInput()
offset_curve = OffsetCurve(Curve=curve_3, Distance=distance, Plane=rotate.Geometry, Corners=1)  # -> simplify(Curve)
end_points = EndPoints(Curve=curve_3)  # -> Start, End
end_points_2 = EndPoints(Curve=offset_curve)  # -> Start, End
line = Line(StartPoint=end_points.End, EndPoint=end_points_2.End)
line_2 = Line(StartPoint=end_points.Start, EndPoint=end_points_2.Start)
join_curves = JoinCurves(Curves=[line, line_2, curve_3, offset_curve], Preserve=False)
curves = ClusterOutput(join_curves)
